# Grasshopper definition EXAMPLE_PHOEBE.gh (Grasshopper 1.0.8)
# plug-ins: PHOEBE.Components

point = Point(Point(0, 0, 0))
geometry = Geometry(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)
geometry_2 = Geometry([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])
curve = Curve([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])
point_2 = Point([Point(13.5, 0, 0), Point(12.5, 0, 0), Point(13.5, 1, 1)])
curve_2 = Curve([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])
point_3 = Point([Point(16, 0, 0), Point(16, 1, 1), Point(15, 0, 1)])
geometry_3 = Geometry(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)
curve_3 = Curve([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])
point_4 = Point([Point(22.5, 0, 0), Point(23.5, 1, 0), Point(22.5, 0, 1), Point(23.5, 1, 1)])
geometry_4 = Geometry(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)
curve_4 = Curve([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])
point_5 = Point([Point(25, 0, 0), Point(26, 1, 0), Point(26, 1, 1), Point(25, 1, 0)])
geometry_5 = Geometry([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])
geometry_6 = Geometry([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])
point_6 = Point([Point(30, 0, 0), Point(31, 1, 0), Point(31, 0, 1), Point(30, 1, 1)])
point_7 = Point([Point(33.5, 1, 0), Point(32.5, 1, 1), Point(33.5, 0, 0), Point(32.5, 1, 0)])
geometry_7 = Geometry(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)
curve_5 = Curve([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])
geometry_8 = Geometry(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)
curve_6 = Curve([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])
point_8 = Point([Point(2.5, 0, 0), Point(3.5, 0, 0)])
geometry_9 = Geometry(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)
curve_7 = Curve([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])
point_9 = Point([Point(7.5, 0, 0), Point(8.5, 1, 1)])
curve_8 = Curve([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])
point_10 = Point([Point(10, 1, 0), Point(11, 1, 0), Point(11, 0, 0)])
geometry_10 = Geometry([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])
curve_9 = Curve([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])
point_11 = Point([Point(18.5, 0, 0), Point(17.5, 0, 0), Point(18.5, 1, 0), Point(17.5, 1, 0)])
geometry_11 = Geometry(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)
curve_10 = Curve([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])
point_12 = Point([Point(20, 0, 0), Point(21, 1, 0), Point(20, 1, 0), Point(20, 1, 1)])
geometry_12 = Geometry([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])
curve_11 = Curve([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])
point_13 = Point([Point(28.5, 1, 0), Point(27.5, 1, 0), Point(28.5, 0, 0), Point(27.5, 0, 1)])
curve_12 = Curve([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])
geometry_13 = Geometry(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)
curve_13 = Curve([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])
point_14 = Point([Point(5, 0, 0), Point(6, 0, 1)])
geometry_14 = Geometry([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])
curve_14 = Curve([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])
mesh_brep = MeshBrep(
    Brep=geometry_7,
    Settings={GridMaxCount=0, GridMinCount=16, JaggedSeams=False, MaxEdgeLength=0, MinEdgeLength=0.0001, MinTolerance=0, Refine=True, RefineAngle=0, RelativeTolerance=0.65, SimplePlanes=True, Tolerance=0})
bbox = BoundingBox(Content=curve_5, Plane=PlaneXY(0, 0, 0), UnionBox=True)  # -> Box, Box_2
bbox_2 = BoundingBox(Content=curve_14, Plane=PlaneXY(0, 0, 0), UnionBox=True)  # -> Box, Box_2
mesh_brep_2 = MeshBrep(
    Brep=geometry_3,
    Settings={GridMaxCount=0, GridMinCount=16, JaggedSeams=False, MaxEdgeLength=0, MinEdgeLength=0.0001, MinTolerance=0, Refine=True, RefineAngle=0, RelativeTolerance=0.65, SimplePlanes=True, Tolerance=0})
mesh_brep_3 = MeshBrep(
    Brep=geometry_8,
    Settings={GridMaxCount=0, GridMinCount=16, JaggedSeams=False, MaxEdgeLength=0, MinEdgeLength=0.0001, MinTolerance=0, Refine=True, RefineAngle=0, RelativeTolerance=0.65, SimplePlanes=True, Tolerance=0})
bbox_3 = BoundingBox(Content=curve_6, Plane=PlaneXY(0, 0, 0), UnionBox=True)  # -> Box, Box_2
mesh_brep_4 = MeshBrep(
    Brep=geometry_9,
    Settings={GridMaxCount=0, GridMinCount=16, JaggedSeams=False, MaxEdgeLength=0, MinEdgeLength=0.0001, MinTolerance=0, Refine=True, RefineAngle=0, RelativeTolerance=0.65, SimplePlanes=True, Tolerance=0})
bbox_4 = BoundingBox(Content=curve_7, Plane=PlaneXY(0, 0, 0), UnionBox=True)  # -> Box, Box_2
mesh_brep_5 = MeshBrep(
    Brep=geometry_14,
    Settings={GridMaxCount=0, GridMinCount=16, JaggedSeams=False, MaxEdgeLength=0, MinEdgeLength=0.0001, MinTolerance=0, Refine=True, RefineAngle=0, RelativeTolerance=0.65, SimplePlanes=True, Tolerance=0})
mesh_brep_6 = MeshBrep(
    Brep=geometry,
    Settings={GridMaxCount=0, GridMinCount=16, JaggedSeams=False, MaxEdgeLength=0, MinEdgeLength=0.0001, MinTolerance=0, Refine=True, RefineAngle=0, RelativeTolerance=0.65, SimplePlanes=True, Tolerance=0})
bbox_5 = BoundingBox(Content=curve_8, Plane=PlaneXY(0, 0, 0), UnionBox=True)  # -> Box, Box_2
mesh_brep_7 = MeshBrep(
    Brep=geometry_2,
    Settings={GridMaxCount=0, GridMinCount=16, JaggedSeams=False, MaxEdgeLength=0, MinEdgeLength=0.0001, MinTolerance=0, Refine=True, RefineAngle=0, RelativeTolerance=0.65, SimplePlanes=True, Tolerance=0})
bbox_6 = BoundingBox(Content=curve, Plane=PlaneXY(0, 0, 0), UnionBox=True)  # -> Box, Box_2
mesh_brep_8 = MeshBrep(
    Brep=geometry_10,
    Settings={GridMaxCount=0, GridMinCount=16, JaggedSeams=False, MaxEdgeLength=0, MinEdgeLength=0.0001, MinTolerance=0, Refine=True, RefineAngle=0, RelativeTolerance=0.65, SimplePlanes=True, Tolerance=0})
bbox_7 = BoundingBox(Content=curve_2, Plane=PlaneXY(0, 0, 0), UnionBox=True)  # -> Box, Box_2
bbox_8 = BoundingBox(Content=curve_9, Plane=PlaneXY(0, 0, 0), UnionBox=True)  # -> Box, Box_2
mesh_brep_9 = MeshBrep(
    Brep=geometry_11,
    Settings={GridMaxCount=0, GridMinCount=16, JaggedSeams=False, MaxEdgeLength=0, MinEdgeLength=0.0001, MinTolerance=0, Refine=True, RefineAngle=0, RelativeTolerance=0.65, SimplePlanes=True, Tolerance=0})
bbox_9 = BoundingBox(Content=curve_10, Plane=PlaneXY(0, 0, 0), UnionBox=True)  # -> Box, Box_2
mesh_brep_10 = MeshBrep(
    Brep=geometry_12,
    Settings={GridMaxCount=0, GridMinCount=16, JaggedSeams=False, MaxEdgeLength=0, MinEdgeLength=0.0001, MinTolerance=0, Refine=True, RefineAngle=0, RelativeTolerance=0.65, SimplePlanes=True, Tolerance=0})
bbox_10 = BoundingBox(Content=curve_3, Plane=PlaneXY(0, 0, 0), UnionBox=True)  # -> Box, Box_2
mesh_brep_11 = MeshBrep(
    Brep=geometry_4,
    Settings={GridMaxCount=0, GridMinCount=16, JaggedSeams=False, MaxEdgeLength=0, MinEdgeLength=0.0001, MinTolerance=0, Refine=True, RefineAngle=0, RelativeTolerance=0.65, SimplePlanes=True, Tolerance=0})
bbox_11 = BoundingBox(Content=curve_4, Plane=PlaneXY(0, 0, 0), UnionBox=True)  # -> Box, Box_2
mesh_brep_12 = MeshBrep(
    Brep=geometry_5,
    Settings={GridMaxCount=0, GridMinCount=16, JaggedSeams=False, MaxEdgeLength=0, MinEdgeLength=0.0001, MinTolerance=0, Refine=True, RefineAngle=0, RelativeTolerance=0.65, SimplePlanes=True, Tolerance=0})
bbox_12 = BoundingBox(Content=curve_11, Plane=PlaneXY(0, 0, 0), UnionBox=True)  # -> Box, Box_2
mesh_brep_13 = MeshBrep(
    Brep=geometry_6,
    Settings={GridMaxCount=0, GridMinCount=16, JaggedSeams=False, MaxEdgeLength=0, MinEdgeLength=0.0001, MinTolerance=0, Refine=True, RefineAngle=0, RelativeTolerance=0.65, SimplePlanes=True, Tolerance=0})
bbox_13 = BoundingBox(Content=curve_12, Plane=PlaneXY(0, 0, 0), UnionBox=True)  # -> Box, Box_2
mesh_brep_14 = MeshBrep(
    Brep=geometry_13,
    Settings={GridMaxCount=0, GridMinCount=16, JaggedSeams=False, MaxEdgeLength=0, MinEdgeLength=0.0001, MinTolerance=0, Refine=True, RefineAngle=0, RelativeTolerance=0.65, SimplePlanes=True, Tolerance=0})
bbox_14 = BoundingBox(Content=curve_13, Plane=PlaneXY(0, 0, 0), UnionBox=True)  # -> Box, Box_2
mesh_join = MeshJoin(Meshes=mesh_brep)
mesh_join_2 = MeshJoin(Meshes=mesh_brep_2)
mesh_join_3 = MeshJoin(Meshes=mesh_brep_9)
mesh_join_4 = MeshJoin(Meshes=mesh_brep_10)
mesh_join_5 = MeshJoin(Meshes=mesh_brep_11)
mesh_join_6 = MeshJoin(Meshes=mesh_brep_12)
mesh_join_7 = MeshJoin(Meshes=mesh_brep_13)
mesh_join_8 = MeshJoin(Meshes=mesh_brep_14)
mesh_join_9 = MeshJoin(Meshes=mesh_brep_4)
mesh_join_10 = MeshJoin(Meshes=mesh_brep_5)
mesh_join_11 = MeshJoin(Meshes=mesh_brep_6)
mesh_join_12 = MeshJoin(Meshes=mesh_brep_7)
mesh_join_13 = MeshJoin(Meshes=mesh_brep_8)
mesh_join_14 = MeshJoin(Meshes=mesh_brep_3)
create_reference = CreateReference(Mesh=mesh_join, Box=bbox.Box, Points=point, Function="default")
create_reference_2 = CreateReference(Mesh=mesh_join_14, Box=bbox_3.Box, Points=point_8, Function="default")
create_reference_3 = CreateReference(Mesh=mesh_join_9, Box=bbox_4.Box, Points=point_14, Function="default")
create_reference_4 = CreateReference(Mesh=mesh_join_10, Box=bbox_2.Box, Points=point_9, Function="default")
create_reference_5 = CreateReference(Mesh=mesh_join_11, Box=bbox_5.Box, Points=point_10, Function="default")
create_reference_6 = CreateReference(Mesh=mesh_join_12, Box=bbox_6.Box, Points=point_2, Function="default")
create_reference_7 = CreateReference(Mesh=mesh_join_13, Box=bbox_7.Box, Points=point_3, Function="default")
create_reference_8 = CreateReference(Mesh=mesh_join_2, Box=bbox_8.Box, Points=point_11, Function="default")
create_reference_9 = CreateReference(Mesh=mesh_join_3, Box=bbox_9.Box, Points=point_12, Function="default")
create_reference_10 = CreateReference(Mesh=mesh_join_4, Box=bbox_10.Box, Points=point_4, Function="default")
create_reference_11 = CreateReference(Mesh=mesh_join_5, Box=bbox_11.Box, Points=point_5, Function="default")
create_reference_12 = CreateReference(Mesh=mesh_join_6, Box=bbox_12.Box, Points=point_13, Function="default")
create_reference_13 = CreateReference(Mesh=mesh_join_7, Box=bbox_13.Box, Points=point_6, Function="default")
create_reference_14 = CreateReference(Mesh=mesh_join_8, Box=bbox_14.Box, Points=point_7, Function="default")
default_collection = Data([create_reference, create_reference_2, create_reference_3, create_reference_4, create_reference_5, create_reference_6, create_reference_7, create_reference_8, create_reference_9, create_reference_10, create_reference_11, create_reference_12, create_reference_13, create_reference_14])
panel = Panel("""default
default
default
default
default
default
default
default
default
default
default""")
pipeline = GeometryPipeline(
    GroupByLayer=False,
    GroupByType=False,
    IncludeHidden=True,
    IncludeLocked=True,
    LayerFilter="Default",
    NameFilter="*",
    SublayerFiltering=True,
    TypeFilter=1)
generate_pannustheka = GeneratePannustheka(Reference=default_collection, Generate=Toggle(True))
create_terrain = CreateTerrain(
    Size_x=Slider(1, range=0..10),
    Size_y=Slider(2, range=0..10),
    Extent_x=Slider(10, range=0..10),
    Extent_y=Slider(10, range=0..100))  # -> Terrain, Chunks
pt = Point(pipeline)
create_floor = CreateFloor(Floor_functions=panel)
create_blueprint = CreateBlueprint(Floors=create_floor)  # -> Blueprint, Ascii_section
create_alive_scheme = CreateAliveScheme(Chunks=create_terrain.Chunks, Points=pt)
visualize_pannustheka = VisualizePannustheka(Pannustheka=generate_pannustheka)  # -> Pannus, Bbox, Points
panel_2 = Panel(create_blueprint.Ascii_section)
wires = BrepWireframe(Brep=visualize_pannustheka.Bbox, Density=-1)
cellular_automata = CellularAutomata(
    Grid=create_terrain.Chunks,
    Cell_height=Slider(2, range=0..10),
    Alive_scheme=create_alive_scheme,
    Blueprint=create_blueprint.Blueprint,
    Run_cellular_automata=Toggle(True))
custom_preview = CustomPreview(Geometry=visualize_pannustheka.Pannus, Material=ColourSwatch(SwatchColor=RGB(95, 131, 158)))
custom_preview_2 = CustomPreview(Geometry=wires, Material=ColourSwatch(SwatchColor=RGB(150, 150, 150)))
custom_preview_3 = CustomPreview(Geometry=visualize_pannustheka.Points, Material=ColourSwatch(SwatchColor=RGB(189, 38, 38)))
pannustheka = FilePath("C:\Users\computer-1\Documents\PANNUSTHEKA\")
visualize_organism = VisualizeOrganism(Organism=cellular_automata)
export_pannustheka = ExportPannustheka(Pannustheka=generate_pannustheka, File_path=pannustheka, Export=Toggle(True))
generate_point_cloud = GeneratePointCloud(Organism=cellular_automata, Division_factor=Slider(1, range=0..10))  # -> Cells, Alive_cells, Dead_cells, Point_cloud, Interesting_cells
visualize_cells = VisualizeCells(Cells=generate_point_cloud.Alive_cells)
visualize_point_cloud = VisualizePointCloud(Point_cloud=generate_point_cloud.Point_cloud)
marching_cubes = MarchingCubes(
    Point_cloud=generate_point_cloud.Point_cloud,
    Interesting_cells=generate_point_cloud.Interesting_cells,
    Library=pannustheka,
    Start_marching=Toggle(True))
visualize_envelope = VisualizeEnvelope(Envelope=marching_cubes)
preview = CustomPreview(Geometry=visualize_envelope, Material=ColourSwatch(SwatchColor=RGB(95, 131, 158)))
