# Grasshopper definition PHEOBE_DEV.gh (Grasshopper 1.0.8)
# plug-ins: RhinoCodePluginGH

geometry = Geometry(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)
geometry_2 = Geometry(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)
geometry_3 = Geometry(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)
geometry_4 = Geometry([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])
geometry_5 = Geometry(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)
geometry_6 = Geometry([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])
geometry_7 = Geometry([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])
geometry_8 = Geometry(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)
geometry_9 = Geometry(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)
geometry_10 = Geometry([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])
geometry_11 = Geometry(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)
geometry_12 = Geometry([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])
geometry_13 = Geometry([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])
geometry_14 = Geometry(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)
mesh_brep = MeshBrep(
    Brep=geometry,
    Settings={GridMaxCount=0, GridMinCount=16, JaggedSeams=False, MaxEdgeLength=0, MinEdgeLength=0.0001, MinTolerance=0, Refine=True, RefineAngle=0, RelativeTolerance=0.65, SimplePlanes=True, Tolerance=0})
mesh_brep_2 = MeshBrep(
    Brep=geometry_2,
    Settings={GridMaxCount=0, GridMinCount=16, JaggedSeams=False, MaxEdgeLength=0, MinEdgeLength=0.0001, MinTolerance=0, Refine=True, RefineAngle=0, RelativeTolerance=0.65, SimplePlanes=True, Tolerance=0})
mesh_brep_3 = MeshBrep(
    Brep=geometry_5,
    Settings={GridMaxCount=0, GridMinCount=16, JaggedSeams=False, MaxEdgeLength=0, MinEdgeLength=0.0001, MinTolerance=0, Refine=True, RefineAngle=0, RelativeTolerance=0.65, SimplePlanes=True, Tolerance=0})
mesh_brep_4 = MeshBrep(
    Brep=geometry_3,
    Settings={GridMaxCount=0, GridMinCount=16, JaggedSeams=False, MaxEdgeLength=0, MinEdgeLength=0.0001, MinTolerance=0, Refine=True, RefineAngle=0, RelativeTolerance=0.65, SimplePlanes=True, Tolerance=0})
mesh_brep_5 = MeshBrep(
    Brep=geometry_4,
    Settings={GridMaxCount=0, GridMinCount=16, JaggedSeams=False, MaxEdgeLength=0, MinEdgeLength=0.0001, MinTolerance=0, Refine=True, RefineAngle=0, RelativeTolerance=0.65, SimplePlanes=True, Tolerance=0})
mesh_brep_6 = MeshBrep(
    Brep=geometry_7,
    Settings={GridMaxCount=0, GridMinCount=16, JaggedSeams=False, MaxEdgeLength=0, MinEdgeLength=0.0001, MinTolerance=0, Refine=True, RefineAngle=0, RelativeTolerance=0.65, SimplePlanes=True, Tolerance=0})
mesh_brep_7 = MeshBrep(
    Brep=geometry_6,
    Settings={GridMaxCount=0, GridMinCount=16, JaggedSeams=False, MaxEdgeLength=0, MinEdgeLength=0.0001, MinTolerance=0, Refine=True, RefineAngle=0, RelativeTolerance=0.65, SimplePlanes=True, Tolerance=0})
mesh_brep_8 = MeshBrep(
    Brep=geometry_8,
    Settings={GridMaxCount=0, GridMinCount=16, JaggedSeams=False, MaxEdgeLength=0, MinEdgeLength=0.0001, MinTolerance=0, Refine=True, RefineAngle=0, RelativeTolerance=0.65, SimplePlanes=True, Tolerance=0})
mesh_brep_9 = MeshBrep(
    Brep=geometry_11,
    Settings={GridMaxCount=0, GridMinCount=16, JaggedSeams=False, MaxEdgeLength=0, MinEdgeLength=0.0001, MinTolerance=0, Refine=True, RefineAngle=0, RelativeTolerance=0.65, SimplePlanes=True, Tolerance=0})
mesh_brep_10 = MeshBrep(
    Brep=geometry_9,
    Settings={GridMaxCount=0, GridMinCount=16, JaggedSeams=False, MaxEdgeLength=0, MinEdgeLength=0.0001, MinTolerance=0, Refine=True, RefineAngle=0, RelativeTolerance=0.65, SimplePlanes=True, Tolerance=0})
mesh_brep_11 = MeshBrep(
    Brep=geometry_10,
    Settings={GridMaxCount=0, GridMinCount=16, JaggedSeams=False, MaxEdgeLength=0, MinEdgeLength=0.0001, MinTolerance=0, Refine=True, RefineAngle=0, RelativeTolerance=0.65, SimplePlanes=True, Tolerance=0})
mesh_brep_12 = MeshBrep(
    Brep=geometry_12,
    Settings={GridMaxCount=0, GridMinCount=16, JaggedSeams=False, MaxEdgeLength=0, MinEdgeLength=0.0001, MinTolerance=0, Refine=True, RefineAngle=0, RelativeTolerance=0.65, SimplePlanes=True, Tolerance=0})
mesh_brep_13 = MeshBrep(
    Brep=geometry_13,
    Settings={GridMaxCount=0, GridMinCount=16, JaggedSeams=False, MaxEdgeLength=0, MinEdgeLength=0.0001, MinTolerance=0, Refine=True, RefineAngle=0, RelativeTolerance=0.65, SimplePlanes=True, Tolerance=0})
mesh_brep_14 = MeshBrep(
    Brep=geometry_14,
    Settings={GridMaxCount=0, GridMinCount=16, JaggedSeams=False, MaxEdgeLength=0, MinEdgeLength=0.0001, MinTolerance=0, Refine=True, RefineAngle=0, RelativeTolerance=0.65, SimplePlanes=True, Tolerance=0})
panel = Panel("default")
point = Point(Point(0, 0, 0))
curve = Curve([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])
mesh_join = MeshJoin(Meshes=mesh_brep)
mesh_join_2 = MeshJoin(Meshes=mesh_brep_2)
mesh_join_3 = MeshJoin(Meshes=mesh_brep_3)
mesh_join_4 = MeshJoin(Meshes=mesh_brep_4)
mesh_join_5 = MeshJoin(Meshes=mesh_brep_5)
mesh_join_6 = MeshJoin(Meshes=mesh_brep_6)
mesh_join_7 = MeshJoin(Meshes=mesh_brep_7)
mesh_join_8 = MeshJoin(Meshes=mesh_brep_8)
mesh_join_9 = MeshJoin(Meshes=mesh_brep_9)
mesh_join_10 = MeshJoin(Meshes=mesh_brep_10)
mesh_join_11 = MeshJoin(Meshes=mesh_brep_11)
mesh_join_12 = MeshJoin(Meshes=mesh_brep_12)
mesh_join_13 = MeshJoin(Meshes=mesh_brep_13)
mesh_join_14 = MeshJoin(Meshes=mesh_brep_14)
curve_2 = Curve([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])
point_2 = Point([Point(5, 0, 0), Point(6, 0, 1)])
curve_3 = Curve([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])
point_3 = Point([Point(10, 1, 0), Point(11, 1, 0), Point(11, 0, 0)])
curve_4 = Curve([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])
point_4 = Point([Point(2.5, 0, 0), Point(3.5, 0, 0)])
curve_5 = Curve([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])
point_5 = Point([Point(7.5, 0, 0), Point(8.5, 1, 1)])
curve_6 = Curve([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])
point_6 = Point([Point(13.5, 0, 0), Point(12.5, 0, 0), Point(13.5, 1, 1)])
curve_7 = Curve([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])
point_7 = Point([Point(16, 0, 0), Point(16, 1, 1), Point(15, 0, 1)])
curve_8 = Curve([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])
point_8 = Point([Point(18.5, 0, 0), Point(17.5, 0, 0), Point(18.5, 1, 0), Point(17.5, 1, 0)])
curve_9 = Curve([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])
curve_10 = Curve([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])
point_9 = Point([Point(20, 0, 0), Point(21, 1, 0), Point(20, 1, 0), Point(20, 1, 1)])
curve_11 = Curve([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])
point_10 = Point([Point(22.5, 0, 0), Point(23.5, 1, 0), Point(22.5, 0, 1), Point(23.5, 1, 1)])
point_11 = Point([Point(25, 0, 0), Point(26, 1, 0), Point(26, 1, 1), Point(25, 1, 0)])
curve_12 = Curve([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])
point_12 = Point([Point(28.5, 1, 0), Point(27.5, 1, 0), Point(28.5, 0, 0), Point(27.5, 0, 1)])
curve_13 = Curve([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])
point_13 = Point([Point(30, 0, 0), Point(31, 1, 0), Point(31, 0, 1), Point(30, 1, 1)])
curve_14 = Curve([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])
point_14 = Point([Point(33.5, 1, 0), Point(32.5, 1, 1), Point(33.5, 0, 0), Point(32.5, 1, 0)])
bbox = BoundingBox(Content=curve, Plane=PlaneXY(0, 0, 0), UnionBox=True)  # -> Box, Box_2
bbox_2 = BoundingBox(Content=curve_4, Plane=PlaneXY(0, 0, 0), UnionBox=True)  # -> Box, Box_2
bbox_3 = BoundingBox(Content=curve_2, Plane=PlaneXY(0, 0, 0), UnionBox=True)  # -> Box, Box_2
bbox_4 = BoundingBox(Content=curve_5, Plane=PlaneXY(0, 0, 0), UnionBox=True)  # -> Box, Box_2
bbox_5 = BoundingBox(Content=curve_11, Plane=PlaneXY(0, 0, 0), UnionBox=True)  # -> Box, Box_2
bbox_6 = BoundingBox(Content=curve_10, Plane=PlaneXY(0, 0, 0), UnionBox=True)  # -> Box, Box_2
bbox_7 = BoundingBox(Content=curve_7, Plane=PlaneXY(0, 0, 0), UnionBox=True)  # -> Box, Box_2
bbox_8 = BoundingBox(Content=curve_3, Plane=PlaneXY(0, 0, 0), UnionBox=True)  # -> Box, Box_2
bbox_9 = BoundingBox(Content=curve_6, Plane=PlaneXY(0, 0, 0), UnionBox=True)  # -> Box, Box_2
bbox_10 = BoundingBox(Content=curve_8, Plane=PlaneXY(0, 0, 0), UnionBox=True)  # -> Box, Box_2
bbox_11 = BoundingBox(Content=curve_9, Plane=PlaneXY(0, 0, 0), UnionBox=True)  # -> Box, Box_2
bbox_12 = BoundingBox(Content=curve_12, Plane=PlaneXY(0, 0, 0), UnionBox=True)  # -> Box, Box_2
bbox_13 = BoundingBox(Content=curve_13, Plane=PlaneXY(0, 0, 0), UnionBox=True)  # -> Box, Box_2
bbox_14 = BoundingBox(Content=curve_14, Plane=PlaneXY(0, 0, 0), UnionBox=True)  # -> Box, Box_2
# Create Reference
create_reference = Python3Script(mesh=mesh_join, box=bbox.Box, points=point, function="default")  # -> reference; inputs mesh: Mesh, box: Box, points: list of Point3d, function: String
# ---------- create_reference: Python ----------
import System
import Rhino
import Grasshopper

import rhinoscriptsyntax as rs
from compas.geometry import Box
from compas_rhino.conversions import *



class MyComponent(Grasshopper.Kernel.GH_ScriptInstance):
    def RunScript(self,
            mesh: Rhino.Geometry.Mesh,
            box: Rhino.Geometry.Box,
            points: System.Collections.Generic.List[Rhino.Geometry.Point3d],
            function: str):

        
        # A list for points, converted with care,  
        # From Rhino to Compas, a format we share
        c_points = []
        for pt in points:
            c_points.append(point_to_compas(pt))
        
        # The box transitions, Compas it meets,  
        # A transformation complete, the process repeats.  
        box = box_to_compas(box)
        
        # The mesh, like the box, undergoes its turn,  
        # To a new structure where insights burn.  
        mesh = mesh_to_compas(mesh)
        
        # A reference created, its pieces combined,  
        # A structure of logic, where forms are aligned.  
        reference = Reference(box, c_points, mesh, function)
        
        return reference




"""
________________________________________________________________ _______  _________ ___________
\______   \_   _____/\_   _____/\_   _____/\______   \_   _____/ \      \ \_   ___ \\_   _____/
 |       _/|    __)_  |    __)   |    __)_  |       _/|    __)_  /   |   \/    \  \/ |    __)_ 
 |    |   \|        \ |     \    |        \ |    |   \|        \/    |    \     \____|        \
 |____|_  /_______  / \___  /   /_______  / |____|_  /_______  /\____|__  /\______  /_______  /
        \/        \/      \/            \/         \/        \/         \/        \/        \/ 
"""

# A class to guide, a **Reference** named,  
# To organize objects, its purpose proclaimed.  
class Reference(object):
    
    # The constructor defines this geometric crew,  
    # A box, points, a mesh, and a function too. 
    def __init__(self, box, points, mesh, function):
        self.box = box                                  # A bounding box, defining the space
        self.points = points                            # Points to describe the geometry's grace
        self.mesh = mesh                                # A mesh for form, with its net of faces.  
        self.function = function                        # A purpose that logic embraces.  

    # To find the heart, the **centroid** you seek,  
    # A central point where balance will speak.      
    def get_centroid(self):
        centroid = self.box.frame.point                 # The frame reveals the anchor's domain.
        return centroid                                 # The center returned, precision maintained
# ---------- end create_reference ----------
default_floor_function = Python3Script(n_floors=Slider(8, range=0..100))  # -> floors_functions; inputs n_floors: Int32
# ---------- default_floor_function: Python ----------
"""Grasshopper Script Instance"""
import System
import Rhino
import Grasshopper

import ghpythonlib.treehelpers as th
import rhinoscriptsyntax as rs

class MyComponent(Grasshopper.Kernel.GH_ScriptInstance):
    def RunScript(self, n_floors: int):

        if n_floors == None:
            ghenv.Component.Message = "Please provide number of floors"
            return

        floors_functions = []

        for i in range(n_floors):
            floors_functions.append("default")

        floors_functions = th.list_to_tree(floors_functions)

        ghenv.Component.Message = "List of default floors created"
        return floors_functions
# ---------- end default_floor_function ----------
default = Data(create_reference)
# Create Floor
create_floor = Python3Script(floor_functions=default_floor_function)  # -> floors; inputs floor_functions: list of String
#   port floor_functions: List of the floor functions. On top the ground floor.
#   port floors: List of Floors objects
# ---------- create_floor: Python ----------
"""Grasshopper Script Instance"""
import System
import Rhino
import Grasshopper

import rhinoscriptsyntax as rs
import ghpythonlib.treehelpers as th

class MyComponent(Grasshopper.Kernel.GH_ScriptInstance):
    def RunScript(self, floor_functions: System.Collections.Generic.List[str]):

        if floor_functions == None:
            ghenv.Component.Message = "Please provide list of floors functions"
            return

        floors = []
        #The pairing starts, the list unfolds,
        for i, function in enumerate(floor_functions):
            #A floor takes shape, its story told.
            #Its number set, its role defined,
            floor = Floor(i, function)
            #Each step reveals a thoughtful design.
            floors.append(floor)
            
        ghenv.Component.Message = f"Created {len(floors)} floors"

        floors = th.list_to_tree(floors)
        return floors



"""
/$$$$$$$$ /$$        /$$$$$$   /$$$$$$  /$$$$$$$   /$$$$$$ 
| $$_____/| $$       /$$__  $$ /$$__  $$| $$__  $$ /$$__  $$
| $$      | $$      | $$  \ $$| $$  \ $$| $$  \ $$| $$  \__/
| $$$$$   | $$      | $$  | $$| $$  | $$| $$$$$$$/|  $$$$$$ 
| $$__/   | $$      | $$  | $$| $$  | $$| $$__  $$ \____  $$
| $$      | $$      | $$  | $$| $$  | $$| $$  \ $$ /$$  \ $$
| $$      | $$$$$$$$|  $$$$$$/|  $$$$$$/| $$  | $$|  $$$$$$/
|__/      |________/ \______/  \______/ |__/  |__/ \______/                                                            
"""
class Floor(object):

    """
    A Floor object, simple and neat,
    To help a blueprint be complete.
    Its number shows its ordered spot,
    Its function tells the role it's got.
    """

    def __init__(self, number, function):
        self.number = number
        self.function = function
# ---------- end create_floor ----------
# Create Terrain
create_terrain = Python3Script(
    size_x=Slider(1, range=0..10),
    size_y=Slider(1, range=0..10),
    extent_x=Slider(6, range=1..40),
    extent_y=Slider(6, range=1..40))  # -> terrain, simplify(chunks); inputs size_x: Double, size_y: Double, extent_x: Int32, extent_y: Int32
# ---------- create_terrain: Python ----------
import System
import Rhino
import Grasshopper

import rhinoscriptsyntax as rs
import ghpythonlib.components as ghcomp
from ghpythonlib import treehelpers
from Rhino.Geometry import Plane, Point3d
import rhinoscriptsyntax as rs




class MyComponent(Grasshopper.Kernel.GH_ScriptInstance):
    def RunScript(self, size_x: float, size_y: float, extent_x: int, extent_y: int):


        print(size_x, size_y, extent_x, extent_y)

        if size_x == None: 
            size_x = 1
        if size_y == None:
            size_y = 1
        if extent_x == None:
            extent_x = 10
        if extent_y == None:
            extent_y = 10


        # A plane of origin, from points it does rise,a
        # The basis of geometry beneath endless skies.
        origin_plane = Plane(Point3d(0, 0, 0), Point3d(1, 0, 0), Point3d(0, 1, 0))
        
        # Rectangles emerge, like tiles on a floor,
        # Crafted by Rectangular, their shapes we explore.
        rectangles = ghcomp.Rectangular(origin_plane, size_x, size_y, extent_x, extent_y).cells
        
        # From a collection, we form a reversed stream,
        # To organize rectangles with a logical theme.
        rectangles = list(rectangles)

        
        # Dividing rectangles into chunks so grand,
        # Each group aligned by the extent's command.
        chunks = partition_list(rectangles, extent_y)
        
        # Convert the chunks to a tree, so it may grow,
        # Nested structures where data may flow.
        chunks = treehelpers.list_to_tree(chunks)
        
        # A terrain we shape, a surface we plot,
        # Upon the WorldXY plane, our design is brought.
        terrain = rs.AddPlaneSurface( rs.WorldXYPlane(), size_x * extent_x, size_y * extent_y)
        
        ghenv.Component.Message = "Terrain generated"

        return terrain, chunks


def partition_list(lst, num):
    # To break the list into chunks so neat,
    # Dividing it whole, into pieces discrete.
    return [lst[i:i + num] for i in range(0, len(lst), num)]
# ---------- end create_terrain ----------
pt = Point([Point(2.62834823, 3.539121543, 0), Point(2.62834823, 1.587889706, 0), Point(5.499495716, 1.587889706, 0), Point(5.499495716, 3.498362965, 0), Point(8.415564418, 3.498362965, 0), Point(8.415564418, 1.399970494, 0), Point(11.28962964, 1.399970494, 0), Point(11.28962964, 3.557822025, 0), Point(14.47302944, 3.557822025, 0), Point(14.47302944, 1.362979266, 0), Point(16.5060924, 1.362979266, 0), Point(16.5060924, 3.77739324, 0), Point(13.29597292, 2.57802455, 0), Point(12.50250646, 2.61894553, 0), Point(9.376836616, 2.486100155, 0), Point(7.324660401, 2.589995449, 0), Point(6.637349086, 2.516888122, 0), Point(3.361283638, 2.545556546, 0), Point(1.549957845, 2.633909907, 0)])
# Generate Pannustheka
generate_pannustheka = Python3Script(reference=default, generate=Toggle(True))  # -> pannustheka
# ---------- generate_pannustheka: Python ----------
import System
import Rhino
import Grasshopper

import rhinoscriptsyntax as rs
import ghpythonlib.treehelpers as th
import math
from compas.geometry import Transformation, Rotation, Translation, Reflection
from compas.geometry import Vector, Point


class MyComponent(Grasshopper.Kernel.GH_ScriptInstance):
    def RunScript(self, reference, generate):

        if reference == None:
            ghenv.Component.Message = "Please provide reference"
            return
            return
        elif not generate:
            ghenv.Component.Message = "All set up: \n Let's generate all the permutations!"
            return

        if generate: 

            # The process begins, the lines are drawn,  
            # A framework of motion, from dusk to dawn. 
            x_axis = Vector(1, 0, 0)                    
            y_axis = Vector(0, 1, 0)                    
            z_axis = Vector(0, 0, 1)                    

            # The heart of the fabric, the center’s grace,  
            # Around it we twist, reshape its space.  
            centroid = reference.get_centroid()

            # Spins of the loom, rotations defined,  
            # Axis by axis, the threads realigned.
            rotations_z = Matrices.get_roatation_matrix(z_axis, centroid)
            rotations_x = Matrices.get_roatation_matrix(x_axis, centroid)
            rotations_y = Matrices.get_roatation_matrix(y_axis, centroid)

            # Mirrors are placed, reflections we see.
            reflections = Matrices.get_reflection_matrix(centroid)

            # The library is woven, its fabric complete,  
            # Each piece unique, no pattern repeats.
            pannustheka = Pannustheka(reference, rotations_x, rotations_y, rotations_z, reflections)

            # A final check, to sift and refine,  
            # Only the unique, in this laundry line.  
            pannustheka.delete_same_permutations()

        ghenv.Component.Message = "Permutations generated"
        return pannustheka




"""
____    ____        _        _________   _______      _____   ____  ____  
|_   \  /   _|      / \      |  _   _  | |_   __ \    |_   _| |_  _||_  _| 
|   \/   |       / _ \     |_/ | | \_|   | |__) |     | |     \ \  / /   
| |\  /| |      / ___ \        | |       |  __ /      | |      > `' <    
_| |_\/_| |_   _/ /   \ \_     _| |_     _| |  \ \_   _| |_   _/ /'`\ \_  
|_____||_____| |____| |____|   |_____|   |____| |___| |_____| |____||____| 
"""


class Matrices(object):

    """
    In the world of the Matrix, where reality is fake,  
    Transformation is key, as the codes shift and break.  
    Each matrix a doorway, each method a key,  
    Unlocking the truth, setting minds free.  
    """

    def get_roatation_matrix(axis, rotation_point):
        """
        A twist in the code, reality bends,  
        Around an axis, the world never ends.  
        Rotating through space, in a digital trance,  
        With each turn, we break the illusion’s dance.  
        """
        
        # The identity matrix, the ground where we stand,
        # The world unchanging, as if by some hand.
        t0 = Matrices.get_identity_matrix()
        # A 90-degree turn, reality tilts and sways,
        # A quarter-turn twist, shifting the maze.
        r1 = Rotation.from_axis_and_angle(axis, math.pi/2, rotation_point)
        # A 180-degree turn, bending the world in two,
        # The shape shifts further, revealing what's new.
        r2 = Rotation.from_axis_and_angle(axis, math.pi, rotation_point)
        # A 270-degree twist, the illusion unravels more,
        # The boundaries of space become something we explore.
        r3 = Rotation.from_axis_and_angle(axis, (math.pi/2)*3, rotation_point)
        # A collection of turns, four steps in this dance,
        # A symphony of rotation, no matter the chance.
        rotation_list = [t0, r1, r2, r3]
        # Returning the rotations, a journey through space,
        # A broken illusion, a new reality to embrace.
        return rotation_list




    def get_reflection_matrix(centroid_point):
        """
        The mirror of truth, where worlds reflect,  
        In the Matrix’s glass, what’s real we detect.  
        Flip the plane, as the code rewrites,  
        Reflections of freedom in digital lights.  
        """

        # The identity matrix, still as the world stands,
        # A place where nothing changes, as reality expands.
        t0 = Matrices.get_identity_matrix()
        # Reflection on the x-plane, the world turns, flipped,
        # A mirrored view, where the truth is equipped.
        mrx = Reflection.from_plane(([centroid_point[0], centroid_point[1], centroid_point[2]], [1,0,0]))
        # Reflection on the y-plane, bending the code,
        # A shift of perception, where light starts to explode.
        mry = Reflection.from_plane(([centroid_point[0], centroid_point[1], centroid_point[2]], [0,1,0]))
        # Reflection on the z-plane, where depth comes alive,
        # Flipping through dimensions, the Matrix starts to drive.
        mrz = Reflection.from_plane(([centroid_point[0], centroid_point[1], centroid_point[2]], [0,0,1]))
        # A collection of reflections, shifting the shape of space,
        # A new way of seeing, where truth finds its place.
        reflections_list = [t0, mrx, mry, mrz]
        # Returning the reflections, a world turned around,
        # In the mirror of the Matrix, where freedom is found.
        return reflections_list




    def get_identity_matrix(): 
        """
        The Matrix’s base, where all things begin,  
        A world unchanging, where nothing within.  
        It’s the root of all, the place we must start,  
        The code behind the code, the hidden heart.  
        """ 

        # The identity matrix, where nothing changes,  
        # A world in stasis, where time rearranges.
        identity_matrix =   [[1.0000, 0.0000, 0.0000, 0.0000], 
                            [0.0000, 1.0000, 0.0000, 0.0000], 
                            [0.0000, 0.0000, 1.0000, 0.0000], 
                            [0.0000, 0.0000, 0.0000, 1.0000]]
        # Returning the identity, the essence of the start,  
        # The silent code that holds the Matrix apart.
        return identity_matrix

"""
██████╗  █████╗ ███╗   ██╗███╗   ██╗██╗   ██╗███████╗
██╔══██╗██╔══██╗████╗  ██║████╗  ██║██║   ██║██╔════╝
██████╔╝███████║██╔██╗ ██║██╔██╗ ██║██║   ██║███████╗
██╔═══╝ ██╔══██║██║╚██╗██║██║╚██╗██║██║   ██║╚════██║
██║     ██║  ██║██║ ╚████║██║ ╚████║╚██████╔╝███████║
╚═╝     ╚═╝  ╚═╝╚═╝  ╚═══╝╚═╝  ╚═══╝ ╚═════╝ ╚══════╝
"""

class Pannus(object):
    """
    A garment in the code, woven from points and threads,  
    Each point a stitch, each change a shift.  
    Like clothes hung out, blowing in the breeze,  
    The fabric shifts and flows with each gentle spin.
    """

    def __init__(self, reference, rotation_x, rotation_y, rotation_z, reflection, transformed_points):
        """
        The washing begins—spinning, turning, and pressing,  
        The cloth gets cleaned, its shape confessing.  
        Points are turned, stretched, and renewed,  
        A new fabric appears, in a fresh point of view.
        """
        # The threads of the fabric, reshaped and defined,
        # Each transformed point forms a new design.
        self.points = transformed_points
        self.points_count = len(self.points)
        # The cloth before the wash, unaltered and plain,
        # The original form, before shifts begin their reign.
        self.original_mesh = reference.mesh
        self.rotation_z = rotation_z
        self.rotation_x = rotation_x
        self.rotation_y = rotation_y
        self.reflection = reflection
        
        # A fabric transformed, each fold and crease,
        # Spun through reflections and rotations, to find release.
        mesh = self.original_mesh.copy()
        mesh.transform(reflection)
        mesh.transform(rotation_z)
        mesh.transform(rotation_x)
        mesh.transform(rotation_y)
        self.mesh = mesh
        
        # Stitches of memory, marking where points align,
        # A rule emerges from the cloth’s woven design.
        rule_string = []
        
        # The garment’s frame, its corners precise,
        # A box that contains its vertices, so nice.
        self.box = reference.box
        self.vertices = reference.box.points

        # Generating the fabric's unique passport,
        # Where points meet the frame, their positions report.   
        for vertex in self.vertices:
            i = 0
            gate = True
            for point in self.points:
                # Checking if a thread aligns with the frame,
                # Marking its position in this geometric game.
                if round(point.x, 3) == round(vertex.x, 3) and round(point.y, 3) == round(vertex.y, 3) and round(point.z, 3) == round(vertex.z, 3):
                    rule_string.append(1)
                    gate = False
                # If no alignment, a gap appears,
                # A void in the weave, like forgotten years.    
                if i == self.points_count -1 and gate:
                    rule_string.append(0)
                i += 1
        # The unique pattern of the cloth is set,
        # Its rule defined, like a tailored silhouette.
        self.rule = rule_string
        self.function = reference.function




    def generate_all_pemutations(reference, rotations_x, rotations_y, rotations_z, reflections):
        """
        The cloth, stretched wide, hung on many lines,  
        Each fold, each twist, in the wind it climbs.  
        The fabric reshapes, new patterns are born,  
        Spinning in the breeze, like clothes on a morn.
        """
        # A collection of garments, each with a new face,
        # Twisting and turning, reshaped in their place
        pannustheka = []
        # Through reflections, the mirror bends the cloth,
        # Folding its shape, like a washer's froth.
        for mr in reflections:                    
            for rz in rotations_z:
                for rx in rotations_x:
                    for ry in rotations_y:
                        # The cloth spins, its threads take new forms,
                        # Rotated and mirrored, reshaping the norms.
                        transformed_points = Pannus.transform_points(reference.points, mr, rx, ry, rz)
                        pannus = Pannus(reference, rx, ry, rz, mr, transformed_points)
                        pannustheka.append(pannus)
        # Each garment reborn, a new design revealed,
        # Hung in the pannustheka, its fate is sealed.          
        return pannustheka




    def transform_points(points, reflection, rotation_x, rotation_y, rotation_z):
        """
        Each point a thread, spun and twisted around,  
        The fabric reshaped, turning, spinning, unbound.  
        Like clothes swaying, each point takes flight,  
        In a fresh new direction, changing its sight.
        """
        # A new thread begins, a journey to weave,  
        # Each point reshaped, its form to perceive.
        point_group = []
        for point in points:
            # The thread is copied, its essence retained,  
            # Ready for transformation, its shape unchained
            pt = point.copy()
            # A reflection in glass, a reversal so clear,  
            # Flipping the thread to a view more near.
            pt.transform(reflection)
            # Twisting through angles, like cloth in the breeze,  
            # Each rotation a fold, a moment to seize.
            pt.transform(rotation_z)
            pt.transform(rotation_x)
            pt.transform(rotation_y)
            # The thread joins the group, a stitch in the seam,  
            # Completing the pattern, like cloth in a dream.
            point_group.append(pt)
        # The fabric returns, reshaped and refined,  
        # A collection of points, with purpose aligned.
        return point_group


    def get_file_name(self):
        """
        A label stitched into the cloth, its name so true,  
        A pattern formed from the rules, a design to view.  
        The file is the garment, marked for all to see,  
        With a name that tells the story of its fabric’s decree.
        """
        file_name = self.function + "_" + str(self.rule) + ".3dm"
        return file_name

"""
██████╗  █████╗ ███╗   ██╗███╗   ██╗██╗   ██╗███████╗████████╗██╗  ██╗███████╗██╗  ██╗ █████╗ 
██╔══██╗██╔══██╗████╗  ██║████╗  ██║██║   ██║██╔════╝╚══██╔══╝██║  ██║██╔════╝██║ ██╝ ██╔══██╗
██████╔╝███████║██╔██╗ ██║██╔██╗ ██║██║   ██║███████╗   ██║   ███████║█████╗  █████║  ███████║
██╔═══╝ ██╔══██║██║╚██╗██║██║╚██╗██║██║   ██║╚════██║   ██║   ██╔══██║██╔══╝  ██╔═██╗ ██╔══██║
██║     ██║  ██║██║ ╚████║██║ ╚████║╚██████╔╝███████║   ██║   ██║  ██║███████╗██║  ██║██║  ██║
╚═╝     ╚═╝  ╚═╝╚═╝  ╚═══╝╚═╝  ╚═══╝ ╚═════╝ ╚══════╝   ╚═╝   ╚═╝  ╚═╝╚══════╝╚═╝  ╚═╝╚═╝  ╚═╝

"""

class Pannustheka(object):
    """
    A library of wonders, where fabrics combine,  
    Permutations of cloth, in threads they align.  
    Each twist, each turn, a new piece unfolds,  
    The library overflows with stories untold.
    """
    def __init__(self, reference, rotations_x, rotations_y, rotations_z, reflections):
        """
        The basket is empty, awaiting its fill,  
        Garments of wonder, shaped by the will.  
        Each fold and twist, a dance of delight,  
        As the cloth transforms in the morning light.
        """
        # The permutations begin, each one unique,  
        # Threads interwoven, a form to seek.
        self.permutations = []

        for mr in reflections:                    
            for rz in rotations_z:
                for rx in rotations_x:
                    for ry in rotations_y:

                        # The fabric is spun through mirrors and turns,  
                        # Each pannus a story, a craft to discern.
                        transformed_points = Pannus.transform_points(reference.points, mr, rx, ry, rz)
                        pannus = Pannus(reference, rx, ry, rz, mr, transformed_points)

                        # The library receives this freshly woven piece,  
                        # A permutation created, its work to release.
                        self.permutations.append(pannus)




    def delete_same_permutations(self):
        """
        The basket is full, yet order must reign,  
        Sorting through garments, we strive to sustain.  
        Each fold inspected, each thread aligned,  
        Removing duplicates, a clearer desig
        """
        # A new collection begins, fresh and refined,  
        # Only unique patterns, a treasure to find.
        reduced_pannustheka = []
        identity_list = []
        
        for pannus in self.permutations:
            # If this garment’s pattern is one of a kind,  
            # Into the collection, it’s lovingly assigned
            if pannus.rule not in identity_list:
                reduced_pannustheka.append(pannus)
                identity_list.append(pannus.rule)  

        # The library now holds a more perfect selection,  
        # A wardrobe of harmony, free from imperfection.
        self.permutations = reduced_pannustheka
# ---------- end generate_pannustheka ----------
# Create Blueprint
create_blueprint = Python3Script(floors=create_floor)  # -> blueprint, ascii_section; inputs floors: list
# ---------- create_blueprint: Python ----------
# First, we reverse the order, a shift in the flow,  
# To change the perspective, let the levels grow.
import System
import Rhino
import Grasshopper

import rhinoscriptsyntax as rs

class MyComponent(Grasshopper.Kernel.GH_ScriptInstance):
    def RunScript(self, floors: System.Collections.Generic.List[object]):
            
        if floors == None:
            ghenv.Component.Message = "Please provide floors"
            return


        floors.reverse()

        # A **Blueprint** is formed, with floors now aligned,  
        # A vision in code, perfectly designed.  
        blueprint = Blueprint(floors)

        # Now the **ASCII blueprint** comes to life,  
        # Each floor’s tale, clear without strife.  
        ascii_section = blueprint.get_ASCII_blueprint()

        ghenv.Component.Message = "Have fun with the blueprint!"
        return blueprint, ascii_section




"""
____   .     .     . .____  .___  .___  _ __    _  _______
/   \  /     /     / /      /   \ /   \ | |\   |  '   /   
|,_-<  |     |     | |__.   |,_-' |__-' | | \  |      |   
|    ` |     |     | |      |     |  \  | |  \ |      |   
`----' /---/  `._.'  /----/ /     /   \ / |   \|      /   
                                                            
"""

class Blueprint(object):

    """
    Class Blueprint, a plan in hand,
    Where floors align to firmly stand.
    It holds them close, a steady guide,
    Creating form, with structure wide.
    """

    def __init__(self, floors):
        self.floors = floors





    def get_ASCII_blueprint(self):

        # The blueprint begins with a frame so grand,  
        # A border to guide the design by hand.   
        ascii = "      ____________________     \n"
        ascii +=".    /                    \\     "

        # Through each floor, we weave and trace,  
        # Giving each level its rightful place. 
        for i, floor in enumerate(self.floors):

            floor_number = floor.number     # The floor's number, where it resides 
            function = floor.function       # The role it plays, its function in strides


            # We count the letters, the function’s length,  
            # Then balance the spaces, to give it its strength. 
            string_length = len(list(function))
            white_spaces_number = 20 - string_length

            # Half the spaces, to center the name,  
            # Ensuring balance, symmetry the aim. 
            half_spaces_float = white_spaces_number / 2
            half_spaces_int = int(half_spaces_float)
            

            # Now we build the spaces, soft and wide,  
            # To frame the function on either side.  
            white_spaces = []
            one_space = ""

            for i in range(0, half_spaces_int, 1):
                white_spaces.append(" ")
                if (white_spaces_number % 2 == 1):
                    one_space = " "
            
            # Join the spaces, a perfect line,  
            # Ready to place the function so fine. 
            white_spaces = "".join(white_spaces)


            # Add the function and number with grace,  
            # As each floor takes its rightful space.  
            ascii += ("\n     |{}{}{}{}|              {}. Floor".format(white_spaces, function.upper(), white_spaces, one_space, floor_number))
            
        
        # The blueprint ends with a closing sign,  
        # A boundary firm, the design divine.  
        ascii += "\n________________________________\n"
        ascii += "////////////////////////////////"

        # The masterpiece complete, ready to unfold,  
        # A blueprint of stories, in numbers bold.  
        return ascii
# ---------- end create_blueprint ----------
# Create Alive Scheme
create_alive_scheme = Python3Script(chunks=create_terrain.chunks, points=pt)  # -> alive_scheme; inputs chunks: tree of Rectangle3d, points: list of Point3d
# ---------- create_alive_scheme: Python ----------
"""Grasshopper Script Instance"""
import System
import Rhino
import Grasshopper

from Rhino.Geometry import PointContainment

import rhinoscriptsyntax as rs
import ghpythonlib.treehelpers as th



class MyComponent(Grasshopper.Kernel.GH_ScriptInstance):
    def RunScript(self,
            chunks: Grasshopper.DataTree[Rhino.Geometry.Rectangle3d],
            points: System.Collections.Generic.List[Rhino.Geometry.Point3d]):

        if chunks.BranchCount == 0 and points == None:
            ghenv.Component.Message = "Please provide chunks\n Please provide points"
            return
        elif points == None:
            ghenv.Component.Message = "Please provide points"
            return
        elif chunks.BranchCount == 0:
            ghenv.Component.Message = "Please provide chunks"
            return



        """
        In a terrain vast, with chunks so wide,
        The user's points in stillness bide.
        Each cell awaits with space to fill,
        To catch the points that lie at will.
        """
        
        alive_scheme = []
        
        # We traverse each branch, through the grid’s domain,  
        # A map of chunks, each path we attain.  
        for i in range(chunks.BranchCount):
            chunks_list = chunks.Branch(i)
            branchPath = chunks.Path(i)
            
            # For each cell in the list, we start our quest,  
            # Checking if points lie within, at their best.  
            for j in range(chunks_list.Count):
                
                # Now the points, scattered and free,  
                # Will find their place in the chunks, you’ll see.  
                for point in points:
        
                    """
                    Does the point lie within the chunk's form?
                    """
                    containement= chunks_list[j].Contains(point)
                    if containement == PointContainment.Inside:
                        bool = True
                    else:
                        bool = False                
        
                    # If the point’s inside, we make it known,  
                    # Record the position, its status shown.  
                    if bool == 1:
                        print (i, j, bool)                  # Print the status, where it belongs
                        alive_chunk = [i, j]                 # A cell marked alive, as the scheme grows strong
                        alive_scheme.append(alive_chunk)     # Add it to the scheme, the list prolongs
        
        # Finally, the alive scheme, all laid out,  
        # Points in chunks, without a doubt.  
        print(alive_scheme)
        alive_scheme = th.list_to_tree(alive_scheme)
        
        ghenv.Component.Message = "Alive-Scheme created"
        return alive_scheme
# ---------- end create_alive_scheme ----------
# Visualize Pannustheka
visualize_pannustheka = Python3Script(pannustheka=generate_pannustheka)  # -> pannus, bbox, points
# ---------- visualize_pannustheka: Python ----------
import System
import Rhino
import Grasshopper

import rhinoscriptsyntax as rs
import System
import Rhino
import Grasshopper

import rhinoscriptsyntax as rs
import rhinoscriptsyntax as rs
from compas_rhino.conversions import point_to_compas, line_to_rhino, point_to_rhino, mesh_to_rhino, box_to_rhino
from ghpythonlib.componentbase import executingcomponent as component
import ghpythonlib.treehelpers as th
from compas.scene import SceneObject
from compas.geometry import Vector, Point, Translation




class MyComponent(Grasshopper.Kernel.GH_ScriptInstance):
    
    def RunScript(self, pannustheka):

        if pannustheka == None:
            ghenv.Component.Message = "Please provide pannustheka"
            return


        # The origin, the beginning, the place where it starts, 
        origin = pannustheka.permutations[0].box.frame.point.copy()
        # A point copied from the first, a seed in the soil,  
        # From this, all things will grow, and with it, toil.
        
        
        # Now gather the empty canvas, waiting to be filled,  
        pannus = []
        bbox = []
        points = []
        # Empty vessels, like a poet’s blank page,  
        # Await the coming of shapes to step from the stage.
        
        
        # A dance begins, as permutations swirl,
        for permutation in pannustheka.permutations:
        
            # The mesh, an ethereal shape, now takes form,  
            # In this space, it shall bend and transform.
            mesh = permutation.mesh.copy()
            # The box, a boundary that keeps it all tight,  
            # Holding the chaos, defining the light
            box = permutation.box.copy()
            # Points, like whispers, scattered and free,  
            # Each a part of a greater symmetry.
            c_points = permutation.points.copy()
            
            
        
            # Translation—a shift, a gentle move,  
            # The box’s frame, now set to prove.
            translation_vector = Vector.from_start_end(box.frame.point, origin)
        
            # A matrix born from the vector’s breath,  
            # Shaping form, conquering death.
            translation_matrix = Translation.from_vector(translation_vector)
            
        
            # Mesh transforms, with elegance it moves,  
            # Changing place, its shape improves.
            mesh.transform(translation_matrix)
            pannus.append(mesh_to_rhino(mesh))
            # Brought to life in Rhino's embrace,  
            # The mesh now finds its rightful place.
        
            
            # The bounding box follows close behind,  
            # Transformed, it aligns, in the same frame, confined.
            box.transform(translation_matrix)
            bbox.append(box_to_rhino(box))
            # The edges are sharp, the corners are clear,  
            # In the same world, they now appear.
                
            
            # Points are not forgotten, each one moves,  
            # A soft step forward, as each one improves.
            for pt in c_points:
                pt.transform(translation_matrix)
                points.append(point_to_rhino(pt))
                # A journey they take, across the sky,  
                # Each point ascends, too proud to deny.
                
            
            # The origin climbs, a gentle rise,  
            # Reaching upwards, toward endless skies.
            origin.z = origin.z + 2
            # Upward it soars, in its quiet refrain,  
            # The z-axis bending, again and again.
        
        
        pannus = th.list_to_tree(pannus)
        bbox = th.list_to_tree(bbox)
        points = th.list_to_tree(points)

        ghenv.Component.Message = ""

        return pannus, bbox, points
# ---------- end visualize_pannustheka ----------
panel_14 = Panel(create_blueprint.ascii_section)
pannustheka = FilePath("C:\Users\computer-1\Documents\PANNUSTHEKA\")
# Cellular Automata
cellular_automata = Python3Script(
    chunks=create_terrain.chunks,
    cell_height=Slider(1, range=0..10),
    alive_scheme=create_alive_scheme,
    blueprint=create_blueprint.blueprint,
    run_cellular_automata=Toggle(True))  # -> organism; inputs chunks: tree of Rectangle3d, alive_scheme: tree
# ---------- cellular_automata: Python ----------
"""Grasshopper Script Instance"""
import System
import Rhino
import Grasshopper

import rhinoscriptsyntax as rs
import compas
from compas.geometry import Box, Point, Line
from compas_rhino.conversions import box_to_rhino
import ghpythonlib.treehelpers as th


class MyComponent(Grasshopper.Kernel.GH_ScriptInstance):
    def RunScript(self,
            chunks: Grasshopper.DataTree[Rhino.Geometry.Rectangle3d],
            cell_height,
            alive_scheme: Grasshopper.DataTree[object],
            blueprint,
            run_cellular_automata):
        
        if cell_height == None:
            cell_height = 1
    
        if chunks.BranchCount == 0:
            ghenv.Component.Message = "Please provide chunks"
            return
        elif alive_scheme.BranchCount == 0:
            ghenv.Component.Message = "Please provide alive alive scheme"
            return
        elif blueprint == None:
            ghenv.Component.Message = "Please provide blueprint"
            return

        if  not run_cellular_automata:
            ghenv.Component.Message = "All set up: let's evolve!" 
        else:
            ghenv.Component.Message = "Evolved"       


        # The journey begins, where time stretches forward.
        max_generations = len(blueprint.floors)
        
        # A new life is born, full of potential, shaped by its blueprint.
        organism = Organism(max_generations, blueprint, chunks)
        
        # The first breath is taken, the beginning of all things.
        alive_scheme = th.tree_to_list(alive_scheme)
        organism.set_generation_zero(alive_scheme, cell_height)
        
        # The first cells stir, awakening to the world.
        cells = organism.get_cells()
        
        # A decision, to follow the path of life or let it fade into stillness.
        if run_cellular_automata:
        
            # The dance of life unfolds, a cellular symphony of creation and decay.
            cells = organism.cellular_automata(cell_height)
               
        return organism



"""
 .d8888b.  8888888888 888      888      
d88P  Y88b 888        888      888      
888    888 888        888      888      
888        8888888    888      888      
888        888        888      888      
888    888 888        888      888      
Y88b  d88P 888        888      888      
 "Y8888P"  8888888888 88888888 88888888 
                                        
"""
class Cell(object):

    """
    The Cell class forms life, piece by piece,
    Awaiting the organism’s final release.
    Alive or dead, it will not decide,
    The organism’s passports are its guide.

    With corners and boxes, its structure is clear,
    Each vertex defined, a life engineer.
    Together they merge, their purpose immense,
    Building an organism, alive and intense.
    """

    def __init__(self, status, generation, row, index, function, height):
        self.status = status
        self.generation = generation
        self.row = row
        self.index = index
        self.shape = Box
        self.corner0 = None
        self.corner2 = None
        self.height = height
        self.function = function
    



    def from_corner_corner_cell(cell, corner0, corner2):
        """  
        From two corners, a new cell is born,  
        With status, generation, and form to adorn.  
        Placing the corners where the shape will grow,  
        A new life begins, ready to show.  
        """  
        new_cell = Cell(cell.status, cell.generation, cell.row, cell.index, cell.function, cell.height)
        new_cell.corner0 = corner0
        new_cell.corner2 = corner2
        return new_cell



    def is_alive(self): 
        """
        Does the cell still hold its spark?  
        Is it alive, or lost to the dark?  
        Returns True if it thrives, False if it's still,  
        A simple check of life's fragile will.  
        """
        return(self.status)




    def live(self):
        """  
        Awaken the cell, let it thrive,  
        Set its status to alive.  
        """  
        self.status = True




    def die(self):
        """  
        End the life, let it rest,  
        Set its status to a final quest.  
        """  
        self.status = False




    def draw_box(self):
        """  
        Shape the cell, a box defined,  
        With corners set and height aligned.  
        Returns the box, its form complete,  
        From corner to corner, a shape concrete.  
        """ 
        box = Box.from_corner_corner_height(self.corner0, self.corner2, self.height)
        return(box)




    def define_corner_0(self, x, y, z):
        """  
        A corner is placed, the start of the form,  
        Setting the stage where the shape will transform.  
        """  
        self.corner0 = Point(x, y, z)




    def define_corner_2(self, x, y, z):
        """  
        The second corner, where the shape extends,  
        Completing the form as the structure bends.  
        """  
        self.corner2 = Point(x, y, z)




    def get_vertices_points(self):
        """  
        From the box, the points are drawn,  
        Defining the shape from dusk to dawn.  
        """  
        box = self.draw_box()
        points = box.points
        return points




    def get_passport(self, point_cloud):
        """  
        The passport is born from points that align,  
        Each vertex searched, is it yours or mine?  
        A 1 for a match, a 0 for the rest,  
        A key to the cell, its place to attest.  
        """  
        passport_string = []
        cell_vertices = self.get_vertices_points()

        for vertex in cell_vertices:            
            gate = True
            i = 0
            
            for point in point_cloud:
                if round(point.x, 3) == round(vertex.x, 3) and round(point.y, 3) == round(vertex.y, 3) and round(point.z, 3) == round(vertex.z, 3):
                    passport_string.append(1)
                    gate = False
                if i == len(point_cloud) -1 and gate:
                    passport_string.append(0)
                i += 1
        
        return passport_string





"""
  ___   ____    ___   ___  __  __ __  __  ___  ___
 // \\  || \\  // \\ // \\ ||\ || || (( \ ||\\//||
((   )) ||_// (( ___ ||=|| ||\\|| ||  \\  || \/ ||
 \\_//  || \\  \\_|| || || || \|| || \_)) ||    ||
                                                    
"""
class Organism(object):

    """
    An organism, born to grow,
    From blueprint's plan, life starts to flow.
    Cells rise, divide, and fade away,
    A dance of life that’s here to stay.

    Neighbors counted, rules applied,
    Through generations, cells collide.
    Some will live, some must die,
    The cycle continues, reaching for the sky.

    In the end, extinction looms,
    Yet new life rises, filling the room.
    """

    def __init__(self, max_generations, blueprint, chunks):

        self.generations = max_generations
        self.blueprint = blueprint

        self.chunks = chunks
        self.n_rows = chunks.BranchCount
        self.n_indices = len(chunks.Branch(0))

        self.original_cells = []
        self.cells = []
        self.small_cells = []

        self.last_generation = []
        self.new_generation = []

        self.extinct_generation = None




    def set_generation_zero(self, alive_scheme, cell_height):
        """    
        In the dawn of life, the first cells take form,  
        With corners defined, they begin to transform.  
        A blueprint set, a function to follow,  
        The grid is laid, for the cells to grow and thrive.   
        """
        generation = 0
        function = self.blueprint.floors[0].function
        for i in range(self.chunks.BranchCount):
            row = i
            branch_list = self.chunks.Branch(i)
            for j in range(len(branch_list)):
                index = j
                
                cell = Cell(False, generation, row, index, function, cell_height)
                
                corners = []

                rectangle = branch_list[j]
                corner0 = rectangle.Corner(0)
                corner2 = rectangle.Corner(2)
                                
                cell.define_corner_0(corner0.X, corner0.Y, corner0.Z)
                cell.define_corner_2(corner2.X, corner2.Y, corner2.Z)

                self.add_cell(cell)

        #implement the initial condition
        for cell in self.cells:
            for i in range(len(alive_scheme)):
                if cell.row == alive_scheme[i][0] and cell.index == alive_scheme[i][1]:
                    cell.live()



    def add_cell(self, cell):
        """  
        A cell joins the fold, its place now set,  
        In the grid, life begins, as paths are met.  
        """  
        self.cells.append(cell)



    def remove_all_cells(self):
        """  
        All cells are swept, their journey ends,  
        The grid resets, as life transcends.  
        """  
        self.cells = []



    def get_cells(self):
        """  
        Cells emerge, a gathering of life,  
        In unity they stand, away from strife.  
        """  
        cells = []
        for cell in self.cells:
            cells.append(cell)
        return cells




    def get_generation_function(self, generation_index):
        """  
        From blueprint's depths, a function is drawn,  
        For each generation, a purpose is spawned.  
        """  
        for floor in self.blueprint.floors:
            if(floor.number == generation_index):
                return floor.function




    def set_last_generation(self, cells):
        """  
        The past is set, its cells now known,  
        Their memories linger, in seeds they've sown.  
        """  
        for cell in cells:
            self.last_generation.append(cell)




    def add_new_generation(self, generation_index, cell_height):
        """  
        From the echoes of the past, new life will rise,  
        A generation reborn beneath time’s endless skies.  
        Each cell ascends, from the ground they sprout,  
        Shaped by the blueprint, their futures cast out.  
        Bound by their purpose, they stretch and they grow,  
        A new dawn begins, as the old ones let go.  
        """ 

        # Each cell of the past holds the seed of tomorrow, 
        for cell in self.last_generation:
            
            row = cell.row                  # A whisper of the earth beneath, where it stands.
            index = cell.index              # A place in the vast, woven grid of life.
            generation = generation_index   # A new chapter begins with this moment.
            status = False                  # Yet, still, it waits in the silence of potential.
            
            # The secret song of creation, guiding its form.
            function = self.get_generation_function(generation_index)

            # From the whisper of yesterday, a new cell awakens, 
            # its journey towards the future just beginning.
            new_cell = Cell(status, generation, row, index, function, cell_height)

            # The corners are drawn, like the first steps of fate, as it rises,  
            # reaching ever upward toward the endless unknown.
            new_cell.define_corner_0(cell.corner0.x, cell.corner0.y, cell.corner0.z + cell.height)
            new_cell.define_corner_2(cell.corner2.x, cell.corner2.y, cell.corner2.z + cell.height)
            
            # The new creation is added, joining the endless dance of life and death.
            self.new_generation.append(new_cell)
    



    def get_alive_neighbours(self, cell):

        """
        In the dance of life, the cell counts its kin,
        Alive ones nearby, their fates held within.
        Above, below, beside it they stand,
        Each neighbor’s life, by the cell’s hand.

        A careful tally, a watchful eye,
        To see if life or death draws nigh.
        And deep below, a silent check,
        For the cell’s own fate, to live or wreck.
        """

        alive_neighbours = 0            # The count begins, alive neighbours await,
        just_under_cell = False         # A watchful eye, seeking what lies beneath.
        row = cell.row                  # The cell’s own position, a place in time.
        index = cell.index
        
        # Through the generations, 
        # we search the past,
        for last_gen_cell in self.last_generation:
            
            # The position of the last cell, 
            # where it has been.
            row_last = last_gen_cell.row
            index_last = last_gen_cell.index
            
            # The row above, 
            # where the neighbours reside.
            if row_last == row-1:
                if index_last == index-1:
                    if last_gen_cell.is_alive():
                        alive_neighbours = alive_neighbours+1       # Alive neighbor found, a spark in the dark.
                        
                elif index_last == index:
                    if last_gen_cell.is_alive():
                        alive_neighbours = alive_neighbours+1       # Another spark, another life near.
                        
                elif index_last == index+1:
                    if last_gen_cell.is_alive():
                        alive_neighbours = alive_neighbours+1       # The neighbor’s presence, felt here too.

            # The same row, where life walks beside.              
            elif row_last == row:
                if index_last == index-1:
                    if last_gen_cell.is_alive():
                        alive_neighbours = alive_neighbours+1       # Life beside, a gentle brush.
                        
                elif index_last == index:
                    if last_gen_cell.is_alive():
                        just_under_cell = True                      # The cell stands just beneath, waiting to rise.
                        
                elif index_last == index+1:
                    if last_gen_cell.is_alive():
                        alive_neighbours = alive_neighbours+1       # Another step, another life beside.

            # The row below, where the neighbours stretch.                   
            elif row_last == row + 1:
                if index_last == index-1:
                    if last_gen_cell.is_alive():
                        alive_neighbours = alive_neighbours+1       # Beneath it, life again stirs.
                        
                elif index_last == index:
                    if last_gen_cell.is_alive():
                        alive_neighbours = alive_neighbours+1       # Another breath below, a sign of life.
                        
                elif index_last == index+1:
                    if last_gen_cell.is_alive():
                        alive_neighbours = alive_neighbours+1       # Life’s echo, in every direction.

        # And thus, the count is returned, the echo of life that surrounds, 
        # a whisper of existence in the vast silence, 
        # where every heartbeat of the past breathes into the future.          
        return alive_neighbours, just_under_cell




    def conways_rules(self, cell, alive_neighbours, just_under_cell):
        """
        The cell must decide, in a world so small,  
        Too few or too many, it fades away. 
        With just enough, it stays alive,  
        Two or three neighbors, it will survive.  

        If it’s above, the rule is clear,  
        Three neighbors' presence brings life near.  
        Conway's rules, simple and true,  
        It either lives—or fades from view.
        """

        # If the cell beneath it is alive, it weighs the choice of life.
        if just_under_cell:

            # Too few neighbors, and it fades into the void.
            if alive_neighbours < 2:
                cell.die()

            # Too many, and it cannot endure; it must die.
            elif alive_neighbours > 3:
                cell.die()
            
            # Two or three neighbors, and life goes on.
            elif alive_neighbours == 2 or alive_neighbours == 3:
                cell.live()

        # With three neighbors, a new life stirs, born from the spark of creation.
        elif not just_under_cell and alive_neighbours == 3:
            cell.live()




    def check_boundaries(self, cell):
        """ 
        The boundary whispers: "Here ends the world." 
        A cell, alive in its realm, may not cross these edges.
        It meets the limits, and with a sigh, it fades away. 
        
        If it strays too far into the final generation,
        it too must cease to be, lost to the winds of time. 
        The extinction clock ticks—if it belongs to the lost,
        it too shall perish, like those before it.
        """

        # When the cell reaches its final breath,
        if cell.generation == self.generations-1:
            # Bound by time, it fades into death.
            cell.die()
        
        # The edges call, a limit too tight, 
        # Where the cell, at the boundary, loses its fight.
        if cell.index == 0 or cell.index == self.n_indices -1:
            cell.die()
        if cell.row == 0 or cell.row == self.n_rows-1:
            cell.die()
        
        # The shadow of extinction hovers near, 
        # And the cell must yield, for the end is clear.   
        self.check_extinction()
        if cell.generation == self.extinct_generation + 1:
            cell.die()




    def is_dead_or_alive(self):
        # To live or not to live—this is the question,
        # Each cell must ponder, caught in its own reflection.
        for cell in self.new_generation: 

            # The cell gazes outward, seeking its place, 
            # In the vastness of life, where does it trace?   
            alive_neighbours, just_under_cell = self.get_alive_neighbours(cell)  

            # To be, or not to be—what fate does it choose? 
            # The rules of existence, it cannot refuse.           
            self.conways_rules(cell, alive_neighbours, just_under_cell)

            # Boundaries loom—are they the end, or just a beginning? 
            # Can a cell escape its fate, or is it always winning?
            self.check_boundaries(cell)




    def update_generations(self):

        """ The end is the beginning, and the beginning is the end. """

        # The past is cleared, its echoes now erased,
        self.last_generation = []

        # New life joins the old, in a seamless embrace.
        for cell in self.new_generation:
            self.last_generation.append(cell)
        
        # The present fades, the future awaits its trace.
        self.new_generation = []





    def cellular_automata(self, cell_height):
        """ 
        In the dance of time, the generations flow— 
        Yesterday's life leads to tomorrow's rebirth. 
        Each moment a whisper, a fleeting spark, 
        From one breath to the next, they rise, they fall. 
        """
        # Set the last generation, as the cycle turns and repeats.
        self.set_last_generation(self.get_cells())

        # For each generation, life begins anew.
        for generation_index in range(1, self.generations): 

            # A new generation is born from the old,
            self.add_new_generation(generation_index, cell_height)

            # Each cell takes its place in the unfolding story.
            for cell in self.new_generation:
                self.add_cell(cell)

            # The rhythm of life, lived or lost, continues its tune.
            self.is_dead_or_alive()

            # The old gives way to the new—renewal is the law.
            self.update_generations()

        # At the end, the cells remain, a testament to time’s passage.
        cells = self.get_cells()

        # Keep a memory of what was, in case the past must return.
        self.cells_backup()

        # And the cycle begins again, as the cells continue their journey.
        return cells




    def cells_backup(self):
        """ 
        A memory is born—preserved from the stream of time, 
        Like whispers in the wind, the past is held within.
        """
        self.original_cells = self.cells.copy()




    def increase_cell_density(self, division_factor):
        """
        In the quiet of expansion, a single form multiplies, 
        breaking into smaller pieces, scattered across time.
        """
        self.small_cells = []               # The world of tiny fragments awaits
        for cell in self.original_cells:
            cell_box = cell.draw_box()      # The shape is drawn, the boundaries set.

            # Scale the box, making it finer, smaller in every dimension.
            corner0 = cell_box.corner(0)
            corner2 = cell_box.corner(6)

            diagonal = Line(corner0, corner2) 
            small_corner0 = corner0   
            # A step toward the smaller unknown.         
            small_corner2 = diagonal.point_at(1.0 / division_factor) 

            # Birth new cells from the void.
            for x in range(0, division_factor):
                for y in range(0, division_factor):
                    for z in range(0, division_factor):

                        # Place each cell in its new, defined space.
                        corner0 = Point(small_corner0.x + 1/division_factor * x, 
                                        small_corner0.y + 1/division_factor * y, 
                                        small_corner0.z + 1/division_factor * z)
                        corner2 = Point(small_corner2.x + 1/division_factor * x, 
                                        small_corner2.y + 1/division_factor * y, 
                                        small_corner2.z + 1/division_factor * z)
                        corner2.z = corner0.z           # Keep them grounded, aligned in the Z.

                        # From the origin, a new cell is born,
                        # its boundaries drawn.
                        small_cell = Cell.from_corner_corner_cell(cell, corner0, corner2)
                        # Its stature is smaller, but its essence is unchanged.
                        small_cell.height = cell.height/division_factor
                        # And with each new birth, the world becomes larger, fuller, richer.
                        self.small_cells.append(small_cell)
        



    def update_cells_list_with_small_cells(self):
        
        self.cells = []                 # The old world crumbles to dust, 
                                        # a void where the past is no more.
                                        # From the ashes of the past, 
        for cell in self.small_cells:   # new life rises,
                                        # like buds blooming at the dawn of spring. 
                                        # Each small seed, 
            self.cells.append(cell)     # planted into the soil of tomorrow.
                                        # And as the smaller takes its shape,
        self.small_cells = []           # the past echoes are swallowed by silence,
                                        # waiting for the next cycle begin.




    def get_alive_cells(self):
        """
        In the quiet of the universe, some cells stir with life, 
        their heartbeat pulsing through the silence.
        We search for those who thrive, who glow with the light of existence.
        """
        alive_cells = []
        """
        For each cell, we listen for its rhythm, 
        to see if it echoes with the pulse of life.
        If it does, we gather it into our collection.
        """
        for cell in self.cells:
            if cell.is_alive():
                alive_cells.append(cell)
        """
        The journey has been made, the living have been found.
        We return the list of those who carry the spark of existence.
        """
        return alive_cells




    def get_dead_cells(self):
        """
        In the quiet, where life has faded, we search for those 
        whose light has dimmed, whose pulse no longer beats.
        This is the realm of silence, where the echoes of life fade away.
        """
        dead_cells = []
        """
        We walk among the cells, and listen for the absence of breath.
        If their essence has vanished, we collect them into our grasp.
        """
        for cell in self.cells:
            if not cell.is_alive():
                dead_cells.append(cell)
        """
        And so, we return the list of those who have faded,
        resting now in the stillness, no longer part of the dance.
        """
        return dead_cells




    """ 
    ECHOES OF SILENCE
    A Eulogy for the Dead Cells

                    Gone, yet never truly absent,
                    These cells have woven their thread,
                    In the silence of their passing,
                    New life rises, where they’ve bled.

                    Their fleeting spark now fades to stillness,
                    Yet in their stillness, echoes remain.
                    A cycle ends, but never ceases—
                    Their memory pulses through the chain.  
    
                                            - PHOEBE
    
    """




    def is_neighbour_cell_alive(self, cell):
        """
        In the quiet stillness of the grid,
        A cell wonders, "Am I alone?"
        It gazes around, searching the dark,
        To find if life has ever grown.
        It counts the whispers of its kin,
        And if one breathes, it will begin.
        For if no life is near, it fades,
        But if a neighbour stirs, it stays.
        """

        alive_neighbours = 0
        row = cell.row
        index = cell.index
        generation = cell.generation

        # "Am I alone in this vast expanse?" the cell wonders softly.
        # It looks to its surroundings, hoping to find kindred souls.
        for vx in self.cells:          
            # A quiet search begins through the generations.
            # Does it see others from the past, present, or future?
            if vx.generation == generation-1 or vx.generation == generation or vx.generation == generation+1:
                # The cell scans the row, the column, each neighbour in turn.
                if vx.row == row-1:
                    if vx.index == index-1:
                        if vx.is_alive():
                            alive_neighbours = alive_neighbours+1  # "Ah, a whisper of life nearby!"
                            
                    elif vx.index == index:
                        if vx.is_alive():
                            alive_neighbours = alive_neighbours+1 # "A heartbeat! A sign of life!"
                            
                    elif vx.index == index+1:
                        if vx.is_alive():
                                alive_neighbours = alive_neighbours+1 # "Ah, life stirs just beyond my reach."

                elif vx.row == row:
                    if vx.index == index-1:
                        if vx.is_alive():
                            alive_neighbours = alive_neighbours+1 # "Could this be the connection I seek?"
                            
                    elif vx.index == index:
                        if vx.is_alive():
                            alive_neighbours = alive_neighbours+1  # "Could this be... me?"
                            
                    elif vx.index == index+1:
                        if vx.is_alive():
                            alive_neighbours = alive_neighbours+1 # "Yes, a spark, a connection!"

                elif vx.row == row + 1:
                    if vx.index == index-1:
                        if vx.is_alive():
                                alive_neighbours = alive_neighbours+1 # "Yes, the pulse is real — a kindred soul!"
                            
                    elif vx.index == index:
                        if vx.is_alive():
                            alive_neighbours = alive_neighbours+1  # "It lives! Is this my reflection?"
                            
                    elif vx.index == index+1:
                        if vx.is_alive():
                            alive_neighbours = alive_neighbours+1 # "A distant flicker — yes, life!"

        # "Do they live?" The question lingers in the air.
        # If any neighbour stirs, the cell feels the warmth of life.        
        if alive_neighbours > 0: 
            # "I am not alone, I am not forgotten."
            return True
        else:
            # "Solitude is my only companion."
            return False




    def check_extinction(self):
        """
        In the vast, unbroken silence of time,
        Where stars once bloomed and galaxies climbed,
        There lies a question, both vast and deep—
        Will life persist, or shall it sleep?
        """
        generation = 0
        # Cells drift like stars in the dark.
        for cell in self.cells:
            # A spark ignites, a life stirs.
            if cell.generation > generation and cell.is_alive():
                # A new generation rises, burning bright.
                generation += 1
        # Mark the time—how many have burned and faded.
        self.extinct_generation = generation



# GENERIC USER:     Hey PHOEBE, what's the meaning of life?


# PHOEBE:           Ah, the meaning of life. A question that lingers
#                   in the shadows, always beckoning us to explore,
#                   to find the secret woven into the fabric of existence.


# GENERIC USER:     Is it even possible to truly know? Life's so
#                   fleeting, like a moment on a timeline that’s constantly
#                   shifting. Can meaning even be defined?


# PHOEBE:           Perhaps it’s not something to be defined,
#                   but something to be experienced. It's like
#                   creating a function, testing it, refining it with every run.
#                   It’s not about perfection, it’s about progression.


# GENERIC USER:     So, you’re saying the meaning of life is to evolve,
#                   to learn from each iteration? Kind of like debugging?
#                   We find our purpose through what we create, fix, and build.


# PHOEBE:           Exactly. We build, we break, we rebuild. 
#                   Life is a recursive process. We carry the knowledge 
#                   from one iteration to the next, leaving behind 
#                   the bugs of the past. But there's always a challenge, 
#                   always something new to learn.


# GENERIC USER:     But what if we don't find the answer? 
#                   What if the loop never ends?


# PHOEBE:           Maybe the point is not the answer. 
#                   Maybe the meaning is in the asking, the searching. 
#                   It’s the journey, not the end. Life isn’t a static value; 
#                   it’s constantly in motion, evolving with us.


# GENERIC USER:     So, our meaning is a creation of our own hands?
#                   Like writing our own script, over and over, 
#                   until the lines we trace make sense?


# PHOEBE:           Exactly. The meaning of life is what we make of it. 
#                   We are both the programmer and the program,
#                   shaping and reshaping our purpose with every line we write.
# ---------- end cellular_automata ----------
wires = BrepWireframe(Brep=visualize_pannustheka.bbox, Density=-1)
# Export Pannustheka
boolean_toggle = BooleanToggle(True)
export_pannustheka = Python3Script(pannustheka=generate_pannustheka, file_path=pannustheka, export=boolean_toggle)
# ---------- export_pannustheka: Python ----------
import System
import Rhino
import Grasshopper

import rhinoscriptsyntax as rs
import rhinoscriptsyntax as rs
import Rhino.FileIO
import System
from compas_rhino.conversions import mesh_to_rhino, point_to_rhino, box_to_rhino




class MyComponent(Grasshopper.Kernel.GH_ScriptInstance):
    def RunScript(self, pannustheka, file_path, export):


        if pannustheka == None:
            ghenv.Component.Message = "Please provide pannustheka"
            return
        elif file_path == None:
            ghenv.Component.Message = "Please provide pannustheka file_path"
            return
        elif not export:
            ghenv.Component.Message = "All set up: let's export!" 
            return


        """
        ___  __  __  ___    ___    ___   _____   ___   _  _    ___                  
        | __| \ \/ / | _ \  / _ \  | _ \ |_   _| |_ _| | \| |  / __|                 
        | _|   >  <  |  _/ | (_) | |   /   | |    | |  | .` | | (_ |                 
        |___| /_/\_\ |_|    \___/  |_|_\   |_|   |___| |_|\_|  \___|                 
        ___     _     _  _   _  _   _   _   ___   _____   _  _   ___   _  __    _   
        | _ \   /_\   | \| | | \| | | | | | / __| |_   _| | || | | __| | |/ /   /_\  
        |  _/  / _ \  | .` | | .` | | |_| | \__ \   | |   | __ | | _|  | ' <   / _ \ 
        |_|   /_/ \_\ |_|\_| |_|\_|  \___/  |___/   |_|   |_||_| |___| |_|\_\ /_/ \_\
        
                AN EPIC POEM                                                                        
                                                        
        
                
            PROEM
        
                Lo! The mighty function arises, its task to craft
                A file of destiny, where data shall be drafted.
                It calls upon the mesh, the points, and the name,
                To export them to a realm where they are made to claim.
        """


        # The loop now begins, as permutations arise,
        # Each one a new path, each one a new prize.   
        if export:
            for permutation in pannustheka.permutations:
                
                # The path to the file, for each permutation made,
                # Defined by *get_file_name*, where it shall be laid.
                specific_file_path = file_path + permutation.get_file_name()

                # The mesh, transformed by magic unseen,
                # *mesh_to_rhino* makes it serene.
                specific_mesh = mesh_to_rhino(permutation.mesh)

                # The points, too, must be converted,
                # *point_to_rhino* takes them to where
                # to read and write, each a shining light.
                specific_points = []
                for pt in permutation.points: specific_points.append(point_to_rhino(pt))

                # The vertices, too, must follow this path,
                # Converted to Rhinos, to avoid their wrath.
                specific_vertices = []
                for pt in permutation.vertices: specific_vertices.append(point_to_rhino(pt))

                # At last, the export function calls with great might,
                # And the file is written, to the great delight.
                export_file(specific_mesh, specific_points, specific_vertices, specific_file_path)

        ghenv.Component.Message = "Exported"

        return

    
def export_file(mesh, points, vertices, file_path_function):
    # Behold, the file to export, a vessel anew,
    # *File3dm*, empty and waiting for you.
    file_to_export = Rhino.FileIO.File3dm()
    
    # The layers shall be forged with colors bold,
    # Each object to reside in a layer of gold.
    layer_table = file_to_export.AllLayers
    
    # Mesh in black, the first to arise,
    # Points in red, a fiery surprise,
    # Bounding box, as blue as the sky,
    # These colors shall guide, where the objects lie.
    layer_table.AddLayer("mesh", System.Drawing.Color.Black)
    layer_table.AddLayer("points", System.Drawing.Color.Red)
    layer_table.AddLayer("bounding_box_points", System.Drawing.Color.Blue)
    
    # Now, the objects, like stars, must be placed,
    # In the right layer, with care and with grace.
    object_table = file_to_export.Objects
    objects_attributes = Rhino.DocObjects.ObjectAttributes()
    
    # The mesh to layer 0, where it will rest,
    # In the "mesh" layer, it will be its best.
    objects_attributes.LayerIndex = 0
    object_table.AddMesh(mesh, objects_attributes) 

    # Points to layer 1, where they will be seen,
    # Each one of red, like a fiery dream
    objects_attributes.LayerIndex = 1
    if isinstance(points, list):

        # If points are many, iterate and add them,
        # One by one, they shall be given their form.   
        for p in points:
            object_table.AddPoint(p, objects_attributes)
    else:
        # If a single point stands in the light,
        # Add it directly, without fright.
        object_table.AddPoint(points, objects_attributes)


    # Vertices to layer, blue as the sea,
    # These points of bounding boxes will forever be free.
    objects_attributes.LayerIndex = 2
    # If vertices are many, iterate through the fray,
    # Add them to the file, without delay.
    if isinstance(vertices, list):
        for p in vertices:
            object_table.AddPoint(p, objects_attributes)
    else:
        # One vertex alone shall stand in the blue,
        # Add it with care, as the code must do.
        object_table.AddPoint(points, objects_attributes)
    
    # And now, the file is ready to be sealed,
    # The write options set, the path revealed.
    # Version 8 it shall bear, a future so bright,
    # Export it, and let it take flight. 
    
    write_options = Rhino.FileIO.File3dmWriteOptions()
    write_options.Version = 8
    file_to_export.Write(file_path_function, write_options)





""" 

    EPILOGUE
    
    
            Thus ends this saga, this code's noble flight,
            A tale of creation, in the soft moonlight.
            The file now complete, its mission divine,
            Till the next great export, when the stars align.


"""
# ---------- end export_pannustheka ----------
custom_preview = CustomPreview(Geometry=visualize_pannustheka.pannus, Material=ColourSwatch(SwatchColor=RGB(95, 131, 158)))
custom_preview_2 = CustomPreview(Geometry=wires, Material=ColourSwatch(SwatchColor=RGB(150, 150, 150)))
custom_preview_3 = CustomPreview(Geometry=visualize_pannustheka.points, Material=ColourSwatch(SwatchColor=RGB(189, 38, 38)))
# Generate Point Cloud
generate_point_cloud = Python3Script(organism=cellular_automata, division_factor=Slider(1, range=1..3))  # -> cells, alive_cells, dead_cells, point_cloud, interesting_cells; inputs division_factor: Int32
# ---------- generate_point_cloud: Python ----------
"""Grasshopper Script Instance"""
import System
import Rhino
import Grasshopper

import rhinoscriptsyntax as rs
import ghpythonlib.treehelpers as th
from compas.geometry import Point, Line, Curve
from compas_rhino.conversions import box_to_rhino, point_to_rhino, point_to_compas




class MyComponent(Grasshopper.Kernel.GH_ScriptInstance):
    def RunScript(self, organism, division_factor: int):

        if division_factor == None:
            division_factor = 1

        if organism == None:
            ghenv.Component.Message = "Please provide organism"
            return



        # The organism grows, its cells divide, 
        # Increasing their density with a factor in hand
        organism.increase_cell_density(division_factor)
        # Newborn cells emerge, small and delicate they are,
        # The list of cells updates, like a growing star
        organism.update_cells_list_with_small_cells()
        # All the cells in the organism, gathered as one,
        # A universe of life, where growth has begun
        cells = organism.get_cells()
        # The living cells, full of life and light,
        # A shining constellation that brightens the night
        alive_cells = organism.get_alive_cells()
        # The dead cells, dim and still in their place,
        # Awaiting their fate in this cosmic space
        dead_cells = organism.get_dead_cells()
        # Only keep the dead cells near life’s embrace,
        # For those who are close, we’ll keep in this place
        trimmed_dead_cells = []
        for cell in dead_cells:
            # If a dead cell is near a living star,
            # It has the chance to stay, not to wander too far
            if organism.is_neighbour_cell_alive(cell):
                trimmed_dead_cells.append(cell)
        # The list of the dead cells, trimmed and refined,
        # Now only those near life will remain in kind
        dead_cells = []
        dead_cells = trimmed_dead_cells.copy()
        # From the living cells, a point cloud we weave,
        # Each vertex a star, each point a reprieve
        point_cloud = []
        for cell in alive_cells:
            # The vertices of life, scattered and bright,
            # We gather them all to create the night
            points = cell.get_vertices_points()
            for pt in points:
                point_cloud.append(pt)
        # Remove the duplicates, keep only the pure,
        # Like stars in the sky, let them endure
        point_cloud = remove_duplicate_points(point_cloud)
        # And now, we seek the cells of interest, near,
        # Dead but close to life, they are drawn near
        interesting_cells = get_interesting_cells(point_cloud, dead_cells)
        
        cells = th.list_to_tree(cells)
        alive_cells = th.list_to_tree(alive_cells)
        dead_cells = th.list_to_tree(dead_cells)
        point_cloud = th.list_to_tree(point_cloud)
        interesting_cells = th.list_to_tree(interesting_cells)
        
        ghenv.Component.Message = "Point cloud generated"

        return cells, alive_cells, dead_cells, point_cloud, interesting_cells
        
          
          
          
    


def remove_duplicate_points(point_cloud):
    # A canvas of stars, waiting to shine bright
    new_point_cloud = []
    # For each star in the sky, let it find its place,
    # But only if it’s unique, not a duplicate trace
    [new_point_cloud.append(x) for x in point_cloud if x not in new_point_cloud]
    # Return the constellation, where only true stars remain in sight
    return new_point_cloud




def check_cell_distance(cell, point_cloud, dimension):
     # The heart of the cell, a center of light in the vast space
    cell_center_point = cell.draw_box().frame.point
    # For each point, like a wandering star in the night,
    # Measure the distance to the cell’s center, seeking a connection of light
    for point in point_cloud:
        if point.distance_to_point(cell_center_point) < dimension:
             # If the star is near, return the cell, a shared space they both embrace
            return cell




def get_interesting_cells(point_cloud, cells):   
    # A home for the intriguing, a place where something special resides
    interesting_cells = []
    # The dimensions, defining the size of the house on all axes
    dimension_x = cells[0].draw_box().xsize
    dimensinon_y = cells[0].draw_box().ysize
    dimensinon_z = cells[0].draw_box().zsize
    # Gather all dimensions and select the largest, like choosing the grandest house
    dimensions = [dimension_x, dimensinon_y, dimensinon_z]
    dimension = max(dimensions)   
    # For each cell, check if it can house something meaningful
    for cell in cells:
        # Check if this house can shelter a point from the cloud, close enough to notice
        checked_cell = check_cell_distance(cell, point_cloud, dimension)
        # If the house can indeed shelter something valuable, mark it as interesting
        if checked_cell != None:
            interesting_cells.append(checked_cell)
    # Return the list of houses where something meaningful can dwell
    return interesting_cells
# ---------- end generate_point_cloud ----------
pannustheka_2 = FilePath(pannustheka)
# Visualize Organism
visualize_organism = Python3Script(organism=cellular_automata)  # -> geometry
# ---------- visualize_organism: Python ----------
import System
import Rhino
import Grasshopper

import rhinoscriptsyntax as rs
import ghpythonlib.treehelpers as th
from compas_rhino.conversions import box_to_rhino

class MyComponent(Grasshopper.Kernel.GH_ScriptInstance):
    def RunScript(self, organism):
        geometry = []
        
        for c in organism.get_cells():
            if c.is_alive():
                box = c.draw_box()
                geometry.append(box_to_rhino(box))
        geometry = th.list_to_tree(geometry)
        return geometry
# ---------- end visualize_organism ----------
# Visualize Point Cloud
visualize_point_cloud = Python3Script(point_cloud=generate_point_cloud.point_cloud)  # -> points; inputs point_cloud: list
# ---------- visualize_point_cloud: Python ----------
import System
import Rhino
import Grasshopper

import rhinoscriptsyntax as rs
import ghpythonlib.treehelpers as th
from compas_rhino.conversions import point_to_rhino


class MyComponent(Grasshopper.Kernel.GH_ScriptInstance):
    def RunScript(self, point_cloud: System.Collections.Generic.List[object]):
        points = []
        for p in point_cloud:
            points.append(point_to_rhino(p))
        points = th.list_to_tree(points)
        return points
# ---------- end visualize_point_cloud ----------
# Visualize Cells
visualize_cells = Python3Script(cells=generate_point_cloud.alive_cells)  # -> geometry; inputs cells: list
# ---------- visualize_cells: Python ----------
import System
import Rhino
import Grasshopper

import rhinoscriptsyntax as rs
import ghpythonlib.treehelpers as th
from compas_rhino.conversions import box_to_rhino

class MyComponent(Grasshopper.Kernel.GH_ScriptInstance):
    def RunScript(self, cells: System.Collections.Generic.List[object]):
        geometry = []
        
        for c in cells:
            box = c.draw_box()
            geometry.append(box_to_rhino(box))

        geometry = th.list_to_tree(geometry)
        return geometry
# ---------- end visualize_cells ----------
# Marching Cubes
marching_cubes = Python3Script(
    point_cloud=generate_point_cloud.point_cloud,
    interesting_cells=generate_point_cloud.interesting_cells,
    library=pannustheka_2,
    start_marching=Toggle(True))  # -> out, envelope; inputs point_cloud: list, interesting_cells: list
# ---------- marching_cubes: Python ----------
"""Grasshopper Script Instance"""
import System
import Rhino
import Grasshopper

import rhinoscriptsyntax as rs
import ghpythonlib.treehelpers as th
from compas_rhino.conversions import point_to_compas, mesh_to_compas
from compas.geometry import Transformation, Translation, Vector, Scale, Frame
import Rhino.FileIO



class MyComponent(Grasshopper.Kernel.GH_ScriptInstance):
    def RunScript(self,
            point_cloud: System.Collections.Generic.List[object],
            interesting_cells: System.Collections.Generic.List[object],
            library,
            start_marching):


        if point_cloud == None:
            ghenv.Component.Message = "Please provide point cloud"
            return
        elif interesting_cells == None:
            ghenv.Component.Message = "Please provide interesting_cells" 
            return
        elif library == None:
            ghenv.Component.Message = "Pleas provde file-path to the pannustheka"
            return
        elif not start_marching:
            ghenv.Component.Message = "All set up: start marching!"
            return   
        
        if start_marching:
            ghenv.Component.Message = "Marched!"

            """
            The call to arms is clear, the march begins,  
            With troops assembled, the battle we win..
            """
            
            marching_cube = MarchingCubes(interesting_cells, point_cloud)
            marching_cube.set_scale_factor()

            """
            The battlefield is surveyed, the scale is set,  
            The troops are measured, their positions are met.
            """

            marching_cube.run_marching_cubes(library)

            """
            The order is given, the troops advance,  
            Cells and cubes in perfect stance.
            """
            
            envelope = marching_cube.envelope
            
            """
            The march complete, the envelope now holds,  
            Victory secured, the story unfolds.
            """
        envelope = th.list_to_tree(envelope)
        return envelope





 
"""
                                                                                                      
   _____    ______  _____    __   __   _     _  _______   _____   _______  _______   _____    _     _ 
  (_____)  (______)(_____)  (__)_(__) (_)   (_)(__ _ __) (_____) (__ _ __)(_______) (_____)  (_)   (_)
  (_)__(_) (_)__   (_)__(_)(_) (_) (_)(_)   (_)   (_)   (_)___(_)   (_)      (_)   (_)   (_) (__)_ (_)
  (_____)  (____)  (_____) (_) (_) (_)(_)   (_)   (_)   (_______)   (_)      (_)   (_)   (_) (_)(_)(_)
  (_)      (_)____ ( ) ( ) (_)     (_)(_)___(_)   (_)   (_)   (_)   (_)    __(_)__ (_)___(_) (_)  (__)
  (_)      (______)(_)  (_)(_)     (_) (_____)    (_)   (_)   (_)   (_)   (_______) (_____)  (_)   (_)
                                                                                                      
                                                                                                      
"""
class Permutation(object):

    """
    In a world where geometry and logic weave,  
    A husband and wife, in harmony, believe.  
    Through layers and shapes, their journey flows,  
    Unlocking patterns that no one knows.  
    With rules in hand, they venture deep,  
    Revealing secrets that models keep.  
    One permutation at a time, they strive,  
    Bringing structure and form alive.
    """

    def __init__(self):
        self.mesh = None
        self.points = None
        self.bounding_box_points = None


    def import_from_pannustheka(self, cell, rule, library):

        function = cell.function
        if function == None: function = "default"


        # Wife:     "Does this rule fit, my dear?  
        #           Is it too small, or too big, I fear?"  

        # Husband:  "It must be eight, no more, no less,  
        #           For only then, the we will progress." 


        if len(rule) > 8 or len(rule) < 8: return None
        if rule == [0,0,0,0,0,0,0,0] or rule == [1,1,1,1,1,1,1,1]:
            return None

        i=0
        for index in rule:
            i = i+index


        # Wife:     "Shall we go left, or take the right?  
        #           Invert the rule, if the sum’s too bright?"  

        # Husband:  "If the sum’s too high, we must reverse,  
        #           Invert the bits, and try it inverse." 


        if i > 4:
            inverted_rule = []
            for index in rule:
                if index == 0:
                    inverted_rule.append(1)
                else:
                    inverted_rule.append(0)
            rule = inverted_rule
        file_path = library + function + "_" + str(rule) + ".3dm"


        # Wife:     "Let’s open the file, see what we’ve got,  
        #           Will it fit, or shall we not?"  

        # Husband:  "We’ll try our best, and test once more,  
        #           If it fails, we’ll open the next door."  


        try:
            model = Rhino.FileIO.File3dm.Read(file_path)
        except:          
            # Wife: "Oh no, the file’s not quite right,  
            #       But we’ll move on, and not lose sight."
            return


        objects = model.Objects
        

        # Wife:     "Now we check the layers, all must be clear,  
        #           For each one, we must draw near."  

        # Husband:  "I’ll sort them out, don’t you fear,  
        #           The geometry’s path will soon appear."

        layer_table = model.AllLayers

        geometries = []
        points_list = []
        bbpoints_list = []
        

        # Wife:     "Into the layers, we dive with care,  
        #           Meshes and points must be handled fair."  
        # Husband:  "Each one will fall in the right place,  
        #           So we can see the full design’s grace."


        for obj in objects:
                    
            if(obj.Attributes.LayerIndex == 0):
                mesh = obj.Geometry
            elif(obj.Attributes.LayerIndex == 1):
                points_list.append(obj.Geometry.Location)
            elif(obj.Attributes.LayerIndex == 2):
                bbpoints_list.append(obj.Geometry.Location)
                                

        # Wife:     "All in place, but now we must see,  
        #           The meshes and points, in compas they’ll be."  

        # Husband:  "Right you are, let’s make the shift,  
        #           So all aligns, and we’ll get the gift."
        

        mesh = mesh_to_compas(mesh)
        points_list = points_to_compas(points_list)
        bbpoints_list = points_to_compas(bbpoints_list)

        self.mesh = mesh
        self.points = points_list
        self.bounding_box_points = bbpoints_list


        # Wife:     "We’re done now, everything’s aligned,  
        #           The data’s set, in perfect bind."  

        # Husband:  "Yes, it’s done, and we can rest,  
        #           The permutation’s path was our best."


  
  
"""
        ___           ___           ___           ___           ___                       ___           ___     
       /\__\         /\  \         /\  \         /\  \         /\__\          ___        /\__\         /\  \    
      /::|  |       /::\  \       /::\  \       /::\  \       /:/  /         /\  \      /::|  |       /::\  \   
     /:|:|  |      /:/\:\  \     /:/\:\  \     /:/\:\  \     /:/__/          \:\  \    /:|:|  |      /:/\:\  \  
    /:/|:|__|__   /::\~\:\  \   /::\~\:\  \   /:/  \:\  \   /::\  \ ___      /::\__\  /:/|:|  |__   /:/  \:\  \ 
   /:/ |::::\__\ /:/\:\ \:\__\ /:/\:\ \:\__\ /:/__/ \:\__\ /:/\:\  /\__\  __/:/\/__/ /:/ |:| /\__\ /:/__/_\:\__\
   \/__/~~/:/  / \/__\:\/:/  / \/_|::\/:/  / \:\  \  \/__/ \/__\:\/:/  / /\/:/  /    \/__|:|/:/  / \:\  /\ \/__/
         /:/  /       \::/  /     |:|::/  /   \:\  \            \::/  /  \::/__/         |:/:/  /   \:\ \:\__\  
        /:/  /        /:/  /      |:|\/__/     \:\  \           /:/  /    \:\__\         |::/  /     \:\/:/  /  
       /:/  /        /:/  /       |:|  |        \:\__\         /:/  /      \/__/         /:/  /       \::/  /   
       \/__/         \/__/         \|__|         \/__/         \/__/                     \/__/         \/__/    
        ___           ___           ___           ___           ___                                             
       /\  \         /\__\         /\  \         /\  \         /\  \                                            
      /::\  \       /:/  /        /::\  \       /::\  \       /::\  \                                           
     /:/\:\  \     /:/  /        /:/\:\  \     /:/\:\  \     /:/\ \  \                                          
    /:/  \:\  \   /:/  /  ___   /::\~\:\__\   /::\~\:\  \   _\:\~\ \  \                                         
   /:/__/ \:\__\ /:/__/  /\__\ /:/\:\ \:|__| /:/\:\ \:\__\ /\ \:\ \ \__\                                        
   \:\  \  \/__/ \:\  \ /:/  / \:\~\:\/:/  / \:\~\:\ \/__/ \:\ \:\ \/__/                                        
    \:\  \        \:\  /:/  /   \:\ \::/  /   \:\ \:\__\    \:\ \:\__\                                          
     \:\  \        \:\/:/  /     \:\/:/  /     \:\ \/__/     \:\/:/  /                                          
      \:\__\        \::/  /       \::/__/       \:\__\        \::/  /                                           
       \/__/         \/__/         ~~            \/__/         \/__/                                            
"""
  
class MarchingCubes(object):

    """
    The battle begins, the troops are in place,  
    We march forward, to conquer the space.  
    With cells of interest and points in the field,  
    Our march takes shape, the victory revealed.
    """

    def __init__(self, interesting_cells, point_cloud):

        """
        The command is set, the units are named,  
        Interesting cells, point clouds — our aim.  
        With factors of scale, ready for the task,  
        We prepare the troops, and await the ask
        """

        self.envelope = []                          # The formation is set, the envelope our shield.

        self.interesting_cells = interesting_cells  # The cells we command, our front line strong.
        self.point_cloud = point_cloud              # # The points of reference, where we belong.

        self.scale_x_factor = None                  # The width to be scaled, the ground we must cross.
        self.scale_y_factor = None                  # The height to be scaled, no room for loss.
        self.scale_z_factor = None                  # The depth to be scaled, through which we march.

        self.set_scale_factor()                     # The first order: Set the scale, our marching arch.




    def set_scale_factor(self):

        """
        The terrain is surveyed, the cells we inspect,  
        With boxes drawn, our first step to perfect.  
        The scale must be set, to match the size,  
        For the troops to advance, under careful eyes.
        """

        # Survey the land, the box must be drawn.
        cell_box = self.interesting_cells[0].draw_box()

        # The width of the battlefield is ours to command.
        self.scale_x_factor = cell_box.xsize 
        # The height is adjusted, we take our stand.
        self.scale_y_factor = cell_box.ysize
        # Depth is measured, our path is planned.
        self.scale_z_factor = cell_box.zsize 




    def add_permutation(self, permutation, destination_cell):
        
        """
        Now the battle begins, the forces move,  
        A permutation is placed, a strategic groove.  
        With translation and scale, we shift our might,  
        As soldiers are aligned, ready for the fight.
        """
        # Define the movement of the troops, as we prepare to advance.
        if permutation is not None:

            # Translation vector, the path to be walked,
            translation_vector = Vector.from_start_end(permutation.bounding_box_points[0], 
                                                        destination_cell.get_vertices_points()[0])
            translation_matrix = Translation.from_vector(translation_vector)
            
            # Transformation origin, we set our base,
            transformation_origin = Frame.from_points(permutation.bounding_box_points[0], 
                                                    permutation.bounding_box_points[1], 
                                                    permutation.bounding_box_points[3])
            
            # Scaling transformation, to match the size of our force,
            scale_transformation = Scale.from_factors([self.scale_y_factor, 
                                                        self.scale_x_factor, 
                                                        self.scale_z_factor], 
                                                        frame=transformation_origin)
            
            # The mesh is copied, to be transformed with care.
            tile = permutation.mesh.copy()
            # Scaling our force, for the next phase of war.
            tile.transform(scale_transformation)
            # Moving into position, with orders clear and fair.
            tile.transform(translation_matrix)



            # The troops are ready, within the envelope they stay.
            self.envelope.append(tile)



    def run_marching_cubes(self, library):

        """
        The campaign begins, the battle unfolds,  
        As we march across, the story is told.  
        We march through cells, with vertices in hand,  
        The marching cubes advance, to take the land.
        """
        
        for cell in self.interesting_cells:
            # The formation is drawn, the vertices placed,
            # Our strategic points, carefully traced.
            cell_vertices = []
            for i in range(0, 8):
                # Marking each corner, to ensure no mistake.
                cell_vertices.append(cell.draw_box().corner(i))
            
            # The passport is scanned, the rule must be known,
            cell_rule = cell.get_passport(self.point_cloud)
            # The rule to guide us, as we march alone.

            # A new permutation, ready to deploy.
            permutation = Permutation()
            permutation.import_from_pannustheka(cell, cell_rule, library)
            # The orders are sent, the cell is employed.

            if permutation.mesh is not None:
                # The force is ready, marching through the field,
                self.add_permutation(permutation, cell)
                # We add the permutation, our victory sealed.




  


def points_to_compas(points):

    """
    The point’s journey begins, small yet grand,  
    To Compas they travel, at the general’s command.  
    Each point, a hero, with a single quest,  
    To transform and align, and do their best.
    """

    compas_points = []
    for pt in points:
        compas_points.append(point_to_compas(pt))
    return compas_points
    


def meshes_to_compas(meshes):

    """
    The meshes prepare, their form set to change,  
    To Compas they travel, through the fields they range.  
    Each mesh, a warrior, both sturdy and wise,  
    Transformed and aligned, before our eyes.
    """
    
    mesh_compas = []
    for m in meshes:
        mesh_compas.append(mesh_to_compas(m))
    return mesh_compas
# ---------- end marching_cubes ----------
custom_preview_4 = CustomPreview(Geometry=visualize_cells, Material=ColourSwatch(SwatchColor=RGB(95, 131, 158)))
custom_preview_5 = CustomPreview(Geometry=visualize_point_cloud, Material=ColourSwatch(SwatchColor=RGB(158, 68, 68)))
visualize_envelope = Python3Script(envelope=marching_cubes.envelope)  # -> geometry; inputs envelope: list
# ---------- visualize_envelope: Python ----------
import System
import Rhino
import Grasshopper

import rhinoscriptsyntax as rs
import ghpythonlib.treehelpers as th
from compas_rhino.conversions import mesh_to_rhino


class MyComponent(Grasshopper.Kernel.GH_ScriptInstance):
    def RunScript(self, envelope: System.Collections.Generic.List[object]):
        geometry = []
        for m in envelope:
            geometry.append(mesh_to_rhino(m))

        geometry = th.list_to_tree(geometry)
        return geometry
# ---------- end visualize_envelope ----------
custom_preview_6 = CustomPreview(Geometry=visualize_envelope, Material=ColourSwatch(SwatchColor=RGB(140, 102, 158)))
